# Grasshopper definition BeamDeflection.gh (Grasshopper 0.9.76)

cluster = Cluster()  # -> geometry, deflection
initial_beams = InitialBeams()  # List of concrete beam geometry for deflection analyzis
loadsettings = LoadSettings()  # List of load settings
multfactor = MultFactor()  # Multiplication factor for deflection - 1 = no multiplication
timestep = TimeStep()  # Time steps of fire development [min] - 0 = No fire impact

# ---- group: LoadSettings
data = Data(loadsettings)

# ----
item = ListItem(List=data, Index=0, Wrap=True)  # -> Item, Item1, Item2

# ---- group: Type
num = Number(item.Item1)

# ---- group: Load
num_2 = Number(item.Item)

# ---- group: Beam
brep = Brep(initial_beams)

# ----
time_step = Number(timestep)

# ---- group: Support
num_3 = Number(item.Item2)

# ---- group: Multiplication Factor
num_4 = Number(multfactor)

# ----
# Initial Beam
brep_2 = Brep(brep)

# ----
# E-modulus variation (TO BE REVISED)
minutes = Panel("0 to 240")
remap = RemapNumbers(Value=time_step, Source=minutes, Target=Domain(0, 1))  # -> Mapped, Clipped
range = Range(Domain=Domain(0, 1), Steps=10)
graph = GraphMapper(
    remap.Mapped,
    x0=0,
    x1=1,
    y0=0,
    y1=1,
    container_name="Bezier",
    cpx=[0, 0.148027271, 0.6342856288, 1],
    cpy=[1, 0.3492753506, 0.2620283365, 0.6620869637])
remap_2 = RemapNumbers(Value=graph, Source="0 to 1", Target="0 to 210")  # -> Mapped, Clipped
e_gpa = Panel(remap_2.Mapped)

debrep = DeconstructBrep(Brep=brep_2)  # -> Faces, Edges, Vertices
srf = Surface(debrep.Faces)
area = Area(Geometry=srf)  # -> Area, Centroid
sort = SortList(Keys=area.Area, ValuesA=area.Centroid)  # -> Keys, ValuesA
sort_2 = SortList(Keys=area.Area, ValuesA=srf)  # -> Keys, ValuesA
item_2 = ListItem(List=sort_2.ValuesA, Index=0, Wrap=True)  # -> Item, Item1

debrep_2 = DeconstructBrep(Brep=item_2.Item)  # -> Faces, Edges, Vertices
len = Length(Curve=debrep_2.Edges)
bnd = Bounds(Numbers=len)
dedomain = DeconstructDomain(Domain=bnd)  # -> Start, End
num_5 = Number(dedomain.Start)
num_6 = Number(dedomain.End)

division = Division(A=num_6, B=1000)
division_2 = Division(A=num_5, B=1000)
expression = Expression(w=division_2, h=division, Expression="1/12*w*h^3")
item_3 = ListItem(List=sort.ValuesA, Index=0, Wrap=True)  # -> Item, Item1
i_m4 = Panel(expression)
ln = Line(StartPoint=item_3.Item1, EndPoint=item_3.Item)

divide = DivideCurve(Curve=ln, Count=Slider(20, range=0..100), Kinks=False)  # -> Points, Tangents, Parameters
crv_cp = CurveClosestPoint(Point=divide.Points, Curve=ln)  # -> Point, Parameter, Distance
shatter = Shatter(Curve=ln, Parameters=crv_cp.Parameter)
len_2 = Length(Curve=shatter)
ma = MassAddition(Input=len_2)  # -> Result, flatten(PartialResults)
ins = InsertItems(List=ma.PartialResults, Item="0", Indices="0", Wrap=True)

len_3 = Length(Curve=ln)
expression_2 = Expression(q=num_2, L=len_3, E=e_gpa, I=i_m4, Expression="(1/8*q*1000*(L/1000)^4/(E*10^9*I))*1000")
# Uniform load
expression_3 = Expression(q=num_2, L=len_3, E=e_gpa, I=i_m4, x=ins, Expression="(1/6*q*1000*(L/1000)^4/(E*10^9*I)*(3/4-x/L+1/4*(x/L)^4))*1000")
# Point load
expression_4 = Expression(q=num_2, L=len_3, E=e_gpa, I=i_m4, x=ins, Expression="(1/2*q*1000*(L/1000)^3/(E*10^9*I)*(2/3-x/L+1/3*(x/L)^3))*1000")
expression_5 = Expression(q=num_2, L=len_3, E=e_gpa, I=i_m4, Expression="(1/3*q*1000*(L/1000)^3/(E*10^9*I))*1000")
# Point load
expression_6 = Expression(q=num_2, L=len_3, E=e_gpa, I=i_m4, Expression="(1/48*q*1000*(L/1000)^3/(E*10^9*I))*1000")
# Uniform load
expression_7 = Expression(q=num_2, L=len_3, E=e_gpa, I=i_m4, Expression="(5/384*q*1000*(L/1000)^4/(E*10^9*I))*1000")
umax_mm = Panel(expression_5)
umax_mm_2 = Panel(expression_2)
u_x_mm = Panel(expression_4)
u_x_mm_2 = Panel(expression_3)
umax_mm_3 = Panel(expression_6)
umax_mm_4 = Panel(expression_7)
num_7 = Number(expression_4)
num_8 = Number(expression_3)
num_9 = Number(expression_6)
num_10 = Number(expression_7)
filter = StreamFilter(Gate=num, Stream0=umax_mm_2, Stream1=umax_mm)
filter_2 = StreamFilter(Gate=num, Stream0=num_8, Stream1=num_7)
filter_3 = StreamFilter(Gate=num, Stream0=num_10, Stream1=num_9)
num_11 = Number(filter_3)
num_12 = Number(filter_2)
multiplication = Multiplication(A=num_11, B=num_4)
multiplication_2 = Multiplication(A=num_12, B=num_4)

eval = EvaluateCurve(Curve=reparameterize(ln), Parameter=Slider(0.5, range=0..1))  # -> Point, Tangent, Angle
Z = UnitZ(Factor=expr("x*-1", multiplication))
move = Move(Geometry=eval.Point, Motion=Z)  # -> flatten(Geometry), Transform

# ----
# Re-create beam on curved line
number_slider = Slider(1, range=0..1)
eval_2 = EvaluateCurve(Curve=reparameterize(ln), Parameter=number_slider)  # -> flatten(Point), Tangent, Angle
eval_3 = EvaluateCurve(Curve=reparameterize(ln), Parameter=Slider(0, range=0..1))  # -> flatten(Point), Tangent, Angle
rev = Reverse(Vector=eval_2.Tangent)
rev_2 = Reverse(Vector=eval_3.Tangent)
pt = Point([eval_2.Point, move.Geometry, eval_3.Point])
intcrv_t = InterpolateT(Vertices=pt, Degree=3, TangentStart=rev, TangentEnd=rev_2, KnotStyle=1)  # -> Curve, Length, Domain
intcrv = Interpolate(Vertices=pt, Degree=3, Periodic=False, KnotStyle=1)  # -> Curve, Length, Domain

# ----
# Simply supported both ends
# Orient end surface
number_slider_2 = Slider(1, range=0..1)
srf_2 = Surface(item_2.Item1)
eval_4 = EvaluateCurve(Curve=reparameterize(intcrv.Curve), Parameter=number_slider_2)  # -> Point, Tangent, Angle
pl = PlaneNormal(Origin=eval_3.Point, ZAxis=rev_2)
pl_2 = PlaneNormal(Origin=eval_4.Point, ZAxis=eval_4.Tangent)
prot = RotatePlane(Plane=pl_2, Angle=degrees(-90))
orient = Orient(Geometry=srf_2, Source=pl, Target=prot)  # -> Geometry, Transform

number_slider_3 = Slider(0.5, range=0..1)
Z_2 = UnitZ(Factor=expr("x*-1", multiplication_2))
move_2 = Move(Geometry=divide.Points, Motion=Z_2)  # -> flatten(Geometry), Transform

# ----
# Re-create beam on curved line
number_slider_4 = Slider(1, range=0..1)
eval_5 = EvaluateCurve(Curve=reparameterize(ln), Parameter=number_slider_4)  # -> flatten(Point), Tangent, Angle
eval_6 = EvaluateCurve(Curve=reparameterize(ln), Parameter=Slider(0, range=0..1))  # -> flatten(Point), Tangent, Angle
rev_3 = Reverse(Vector=eval_5.Tangent)
rev_4 = Reverse(Vector=eval_6.Tangent)
pt_2 = Point([eval_5.Point, move.Geometry, eval_6.Point])
intcrv_2 = Interpolate(Vertices=move_2.Geometry, Degree=3, Periodic=False, KnotStyle=1)  # -> Curve, Length, Domain
intcrv_t_2 = InterpolateT(Vertices=pt_2, Degree=3, TangentStart=rev_3, TangentEnd=rev_4, KnotStyle=1)  # -> Curve, Length, Domain

swp1 = Sweep1(Rail=intcrv.Curve, Sections=orient.Geometry, Miter=1)
cap = CapHoles(Brep=swp1)
brep_3 = Brep(cap)

# ---- group: Deflected Beam
brep_4 = Brep(brep_3)

# ---- group: Umax
num_13 = Number(filter_3)

num_14 = Number(filter)

# ----
filter_4 = StreamFilter(Gate=num_3, Stream0=num_13, Stream1=num_14)

# ---- group: Umax
num_15 = Number(filter_4)

# ----
deflection = Deflection(num_15)  # Maximum deflection

# ----
# Cantilever
# Orient end surface
number_slider_5 = Slider(0, range=0..1)
srf_3 = Surface(item_2.Item1)
eval_7 = EvaluateCurve(Curve=reparameterize(intcrv_2.Curve), Parameter=number_slider_5)  # -> Point, Tangent, Angle
eval_8 = EvaluateCurve(Curve=reparameterize(ln), Parameter=Slider(0, range=0..1))  # -> Point, Tangent, Angle
pl_3 = PlaneNormal(Origin=eval_5.Point, ZAxis=rev_3)

rev_5 = Reverse(Vector=eval_7.Tangent)
pl_4 = PlaneNormal(Origin=eval_8.Point, ZAxis=eval_8.Tangent)

pl_5 = PlaneNormal(Origin=eval_7.Point, ZAxis=rev_5)
prot_2 = RotatePlane(Plane=pl_5, Angle=degrees(90))
orient_2 = Orient(Geometry=srf_3, Source=pl_4, Target=prot_2)  # -> Geometry, Transform

orient_3 = Orient(Geometry=srf_3, Source=pl_4, Target=pl_3)  # -> Geometry, Transform
geo = Geometry([orient_3.Geometry, orient_2.Geometry])
swp1_2 = Sweep1(Rail=intcrv_2.Curve, Sections=geo, Miter=1)
cap_2 = CapHoles(Brep=swp1_2)
brep_5 = Brep(cap_2)

# ---- group: Deflected Beam
brep_6 = Brep(brep_5)

# ----
filter_5 = StreamFilter(Gate=num_3, Stream0=brep_4, Stream1=brep_6)

# ---- group: Deflected Beam
brep_7 = Brep(filter_5)

# ----
geometry = Geometry(brep_7)  # Deflected geometry

# ==== cluster Cluster
initial_beams = ClusterInput()  # List of concrete beam geometry for deflection analyzis
loadsettings = ClusterInput()  # List of load settings
multfactor = ClusterInput()  # Multiplication factor for deflection - 1 = no multiplication
timestep = ClusterInput()  # Time steps of fire development [min] - 0 = No fire impact

# ---- group: LoadSettings
data = Data(loadsettings)

# ----
item = ListItem(List=data, Index=0, Wrap=True)  # -> Item, Item1, Item2

# ---- group: Type
num = Number(item.Item1)

# ---- group: Load
num_2 = Number(item.Item)

# ---- group: Beam
brep = Brep(initial_beams)

# ----
time_step = Number(timestep)

# ---- group: Support
num_3 = Number(item.Item2)

# ---- group: Multiplication Factor
num_4 = Number(multfactor)

# ----
# Initial Beam
brep_2 = Brep(brep)

# ----
# E-modulus variation (TO BE REVISED)
minutes = Panel("0 to 240")
remap = RemapNumbers(Value=time_step, Source=minutes, Target=Domain(0, 1))  # -> Mapped, Clipped
range = Range(Domain=Domain(0, 1), Steps=10)
graph = GraphMapper(
    remap.Mapped,
    x0=0,
    x1=1,
    y0=0,
    y1=1,
    container_name="Bezier",
    cpx=[0, 0.148027271, 0.6342856288, 1],
    cpy=[1, 0.3492753506, 0.2620283365, 0.6620869637])
remap_2 = RemapNumbers(Value=graph, Source="0 to 1", Target="0 to 210")  # -> Mapped, Clipped
e_gpa = Panel(remap_2.Mapped)

debrep = DeconstructBrep(Brep=brep_2)  # -> Faces, Edges, Vertices
srf = Surface(debrep.Faces)
area = Area(Geometry=srf)  # -> Area, Centroid
sort = SortList(Keys=area.Area, ValuesA=area.Centroid)  # -> Keys, ValuesA
sort_2 = SortList(Keys=area.Area, ValuesA=srf)  # -> Keys, ValuesA
item_2 = ListItem(List=sort_2.ValuesA, Index=0, Wrap=True)  # -> Item, Item1

debrep_2 = DeconstructBrep(Brep=item_2.Item)  # -> Faces, Edges, Vertices
len = Length(Curve=debrep_2.Edges)
bnd = Bounds(Numbers=len)
dedomain = DeconstructDomain(Domain=bnd)  # -> Start, End
num_5 = Number(dedomain.Start)
num_6 = Number(dedomain.End)

division = Division(A=num_6, B=1000)
division_2 = Division(A=num_5, B=1000)
expression = Expression(w=division_2, h=division, Expression="1/12*w*h^3")
item_3 = ListItem(List=sort.ValuesA, Index=0, Wrap=True)  # -> Item, Item1
i_m4 = Panel(expression)
ln = Line(StartPoint=item_3.Item1, EndPoint=item_3.Item)

divide = DivideCurve(Curve=ln, Count=Slider(20, range=0..100), Kinks=False)  # -> Points, Tangents, Parameters
crv_cp = CurveClosestPoint(Point=divide.Points, Curve=ln)  # -> Point, Parameter, Distance
shatter = Shatter(Curve=ln, Parameters=crv_cp.Parameter)
len_2 = Length(Curve=shatter)
ma = MassAddition(Input=len_2)  # -> Result, flatten(PartialResults)
ins = InsertItems(List=ma.PartialResults, Item="0", Indices="0", Wrap=True)

len_3 = Length(Curve=ln)
expression_2 = Expression(q=num_2, L=len_3, E=e_gpa, I=i_m4, Expression="(1/8*q*1000*(L/1000)^4/(E*10^9*I))*1000")
# Uniform load
expression_3 = Expression(q=num_2, L=len_3, E=e_gpa, I=i_m4, x=ins, Expression="(1/6*q*1000*(L/1000)^4/(E*10^9*I)*(3/4-x/L+1/4*(x/L)^4))*1000")
# Point load
expression_4 = Expression(q=num_2, L=len_3, E=e_gpa, I=i_m4, x=ins, Expression="(1/2*q*1000*(L/1000)^3/(E*10^9*I)*(2/3-x/L+1/3*(x/L)^3))*1000")
expression_5 = Expression(q=num_2, L=len_3, E=e_gpa, I=i_m4, Expression="(1/3*q*1000*(L/1000)^3/(E*10^9*I))*1000")
# Point load
expression_6 = Expression(q=num_2, L=len_3, E=e_gpa, I=i_m4, Expression="(1/48*q*1000*(L/1000)^3/(E*10^9*I))*1000")
# Uniform load
expression_7 = Expression(q=num_2, L=len_3, E=e_gpa, I=i_m4, Expression="(5/384*q*1000*(L/1000)^4/(E*10^9*I))*1000")
umax_mm = Panel(expression_5)
umax_mm_2 = Panel(expression_2)
u_x_mm = Panel(expression_4)
u_x_mm_2 = Panel(expression_3)
umax_mm_3 = Panel(expression_6)
umax_mm_4 = Panel(expression_7)
num_7 = Number(expression_4)
num_8 = Number(expression_3)
num_9 = Number(expression_6)
num_10 = Number(expression_7)
filter = StreamFilter(Gate=num, Stream0=umax_mm_2, Stream1=umax_mm)
filter_2 = StreamFilter(Gate=num, Stream0=num_8, Stream1=num_7)
filter_3 = StreamFilter(Gate=num, Stream0=num_10, Stream1=num_9)
num_11 = Number(filter_3)
num_12 = Number(filter_2)
multiplication = Multiplication(A=num_11, B=num_4)
multiplication_2 = Multiplication(A=num_12, B=num_4)

eval = EvaluateCurve(Curve=reparameterize(ln), Parameter=Slider(0.5, range=0..1))  # -> Point, Tangent, Angle
Z = UnitZ(Factor=expr("x*-1", multiplication))
move = Move(Geometry=eval.Point, Motion=Z)  # -> flatten(Geometry), Transform

# ----
# Re-create beam on curved line
number_slider = Slider(1, range=0..1)
eval_2 = EvaluateCurve(Curve=reparameterize(ln), Parameter=number_slider)  # -> flatten(Point), Tangent, Angle
eval_3 = EvaluateCurve(Curve=reparameterize(ln), Parameter=Slider(0, range=0..1))  # -> flatten(Point), Tangent, Angle
rev = Reverse(Vector=eval_2.Tangent)
rev_2 = Reverse(Vector=eval_3.Tangent)
pt = Point([eval_2.Point, move.Geometry, eval_3.Point])
intcrv_t = InterpolateT(Vertices=pt, Degree=3, TangentStart=rev, TangentEnd=rev_2, KnotStyle=1)  # -> Curve, Length, Domain
intcrv = Interpolate(Vertices=pt, Degree=3, Periodic=False, KnotStyle=1)  # -> Curve, Length, Domain

# ----
# Simply supported both ends
# Orient end surface
number_slider_2 = Slider(1, range=0..1)
srf_2 = Surface(item_2.Item1)
eval_4 = EvaluateCurve(Curve=reparameterize(intcrv.Curve), Parameter=number_slider_2)  # -> Point, Tangent, Angle
pl = PlaneNormal(Origin=eval_3.Point, ZAxis=rev_2)
pl_2 = PlaneNormal(Origin=eval_4.Point, ZAxis=eval_4.Tangent)
prot = RotatePlane(Plane=pl_2, Angle=degrees(-90))
orient = Orient(Geometry=srf_2, Source=pl, Target=prot)  # -> Geometry, Transform

number_slider_3 = Slider(0.5, range=0..1)
Z_2 = UnitZ(Factor=expr("x*-1", multiplication_2))
move_2 = Move(Geometry=divide.Points, Motion=Z_2)  # -> flatten(Geometry), Transform

# ----
# Re-create beam on curved line
number_slider_4 = Slider(1, range=0..1)
eval_5 = EvaluateCurve(Curve=reparameterize(ln), Parameter=number_slider_4)  # -> flatten(Point), Tangent, Angle
eval_6 = EvaluateCurve(Curve=reparameterize(ln), Parameter=Slider(0, range=0..1))  # -> flatten(Point), Tangent, Angle
rev_3 = Reverse(Vector=eval_5.Tangent)
rev_4 = Reverse(Vector=eval_6.Tangent)
pt_2 = Point([eval_5.Point, move.Geometry, eval_6.Point])
intcrv_2 = Interpolate(Vertices=move_2.Geometry, Degree=3, Periodic=False, KnotStyle=1)  # -> Curve, Length, Domain
intcrv_t_2 = InterpolateT(Vertices=pt_2, Degree=3, TangentStart=rev_3, TangentEnd=rev_4, KnotStyle=1)  # -> Curve, Length, Domain

swp1 = Sweep1(Rail=intcrv.Curve, Sections=orient.Geometry, Miter=1)
cap = CapHoles(Brep=swp1)
brep_3 = Brep(cap)

# ---- group: Deflected Beam
brep_4 = Brep(brep_3)

# ---- group: Umax
num_13 = Number(filter_3)

num_14 = Number(filter)

# ----
filter_4 = StreamFilter(Gate=num_3, Stream0=num_13, Stream1=num_14)

# ---- group: Umax
num_15 = Number(filter_4)

# ----
deflection = ClusterOutput(num_15)  # Maximum deflection

# ----
# Cantilever
# Orient end surface
number_slider_5 = Slider(0, range=0..1)
srf_3 = Surface(item_2.Item1)
eval_7 = EvaluateCurve(Curve=reparameterize(intcrv_2.Curve), Parameter=number_slider_5)  # -> Point, Tangent, Angle
eval_8 = EvaluateCurve(Curve=reparameterize(ln), Parameter=Slider(0, range=0..1))  # -> Point, Tangent, Angle
pl_3 = PlaneNormal(Origin=eval_5.Point, ZAxis=rev_3)

rev_5 = Reverse(Vector=eval_7.Tangent)
pl_4 = PlaneNormal(Origin=eval_8.Point, ZAxis=eval_8.Tangent)

pl_5 = PlaneNormal(Origin=eval_7.Point, ZAxis=rev_5)
prot_2 = RotatePlane(Plane=pl_5, Angle=degrees(90))
orient_2 = Orient(Geometry=srf_3, Source=pl_4, Target=prot_2)  # -> Geometry, Transform

orient_3 = Orient(Geometry=srf_3, Source=pl_4, Target=pl_3)  # -> Geometry, Transform
geo = Geometry([orient_3.Geometry, orient_2.Geometry])
swp1_2 = Sweep1(Rail=intcrv_2.Curve, Sections=geo, Miter=1)
cap_2 = CapHoles(Brep=swp1_2)
brep_5 = Brep(cap_2)

# ---- group: Deflected Beam
brep_6 = Brep(brep_5)

# ----
filter_5 = StreamFilter(Gate=num_3, Stream0=brep_4, Stream1=brep_6)

# ---- group: Deflected Beam
brep_7 = Brep(filter_5)

# ----
geometry = ClusterOutput(brep_7)  # Deflected geometry
