# Grasshopper definition Cross-SectionFromBrep.gh (Grasshopper 0.9.76)
# plug-ins: Python Interpreter

xicmhot = Panel("0.9733")
n_hot = Panel("0.7623")
n_cold = Panel("0.6201")
xicmcold = Panel("0.7160")
num = Number(xicmhot)
num_2 = Number(n_hot)
num_3 = Number(n_cold)
num_4 = Number(xicmcold)

panel = Panel("""FireSim

Thomas Dyhr

08-12-2017""")

number_slider = Slider(120, range=0..1000)
exposed = ExposureSettings({"Bottom": 0, "1 side": 1, "2 parallel sides": 2, "1 side + bottom": 2.5, "3 sides": 3, "4 sides": 4}, selected="3 sides")
contype = ConcreteType({"Main group": 1, "Siliceous": 2, "Light aggregate 1800 kg/m3": 3, "Light aggregate 1200 kg/m3": 4, "Light aggregate 600 kg/m3": 5}, selected="Main group")
toggle = BooleanToggle(True)

mainrebars = MainReinforcement(Size=Slider(20, range=0..100), Number=Slider(3, range=0..10))  # -> MainBars; inputs Number: Int32
# ---------- mainrebars: Python ----------
"""
Main Rebar Layout. Component that returns the settings for Main Rebars
-----
FireSim made by Thomas Dyhr, DTU.BYG

    Args:
        Size: Diamter of main rebars [mm] - Default: 16
        Number: Number of main rebars - Default: 4
    Returns:
        MainBars: Main rebar settings for the cross-section 
"""

ghenv.Component.Name = 'Main Reinforcement'
ghenv.Component.NickName = 'MainRebars'
ghenv.Component.Message = 'Main Reinforcement v.001'

## Code ##

#Defaults
defSize = 16
defNumber = 4

if not Size:
    Size = defSize
if not Number:
    Number = defNumber

#Output list
MainBars = []
MainBars.append(Size)
MainBars.append(Number)
# ---------- end mainrebars ----------

# ----
# Inputs
partial_factor = Panel("1.2")
rebartype = ReinforcementBarType({"Hot rolled bars": 0, "Cold worked bars": 4, "Cold worked prestressing steel": 8, "Quenched and tempered, 1500 MPa": 12, "Quenched and self-tempered, 550 MPa": 16}, selected="Cold worked prestressing steel")
stresstype = RebarStressType({"0.2% stress": 1, "2.0% stress": 2}, selected="0.2% stress")
e_modulus_of_steel_20c_gpa = Panel("210")
yield_strength_of_steel_20c_mpa = Panel("1400")
concrete_strength_20c_mpa = Panel("45")

number_slider_2 = Slider(250, range=0..1000)
number_slider_3 = Slider(400, range=0..1000)

mainrebars_2 = MainReinforcement(Size=Slider(20, range=0..100), Number=Slider(3, range=0..10))  # -> MainBars; inputs Number: Int32; same code as mainrebars

shearrebars = ShearReinforcement(Size=Slider(10, range=0..100), Spacing=Slider(100, range=0..1000))  # -> ShearBars
# ---------- shearrebars: Python ----------
"""
Shear Rebar Layout. Component that returns the settings for Shear Rebars
-----
FireSim made by Thomas Dyhr, DTU.BYG

    Args:
        Size: Diameter of rebars [mm] - Default: 12
        Spacing: Spacing of shear rebars - Default: 150
    Returns:
        ShearBars: Shear rebar settings for the cross-section 
"""

ghenv.Component.Name = 'Shear Reinforcement'
ghenv.Component.NickName = 'ShearRebars'
ghenv.Component.Message = 'Shear Reinforcement v.001'

## Code ##

#Defaults
defSize = 12
defSpacing = 150

if not Size:
    Size = defSize
if not Spacing:
    Spacing = defSpacing

#Output list
ShearBars = []
ShearBars.append(Size)
ShearBars.append(Spacing)
# ---------- end shearrebars ----------

# ---- group: Beams
brep = Brep(<brep referenced from the Rhino model>)

# ---- group: Rebars
brep_2 = Brep([<brep referenced from the Rhino model> x4])

# ----
getsection = Cluster(beam_geometries=brep, reinforcment_bars=brep_2)  # -> cross_section_in_middle_of_element, length, width_2, height_2, coordinates, areas, depth_of_rebars
c_script = CSharpScript(
    switcher=Toggle(False),
    canvas_back=ColourSwatch(SwatchColor=RGB(255, 255, 255)),
    canvas_grid=ColourSwatch(SwatchColor=RGB(255, 255, 255)))  # -> out, A; inputs switcher: Boolean, canvas_back: Color, canvas_grid: Color
# ---------- c_script: C# ----------
    if (switcher == true)
    {
      Grasshopper.GUI.Canvas.GH_Skin.canvas_grid = canvas_grid;
      Grasshopper.GUI.Canvas.GH_Skin.canvas_back = canvas_back;
      Grasshopper.GUI.Canvas.GH_Skin.canvas_edge = Color.FromArgb(255, 0, 0, 0);
      Grasshopper.GUI.Canvas.GH_Skin.canvas_shade = Color.FromArgb(80, 0, 0, 0);
    }
    else
    {
      //DEFAULTS
      Grasshopper.GUI.Canvas.GH_Skin.canvas_grid = Color.FromArgb(30, 0, 0, 0);
      Grasshopper.GUI.Canvas.GH_Skin.canvas_back = Color.FromArgb(255, 212, 208, 200);
      Grasshopper.GUI.Canvas.GH_Skin.canvas_edge = Color.FromArgb(255, 0, 0, 0);
      Grasshopper.GUI.Canvas.GH_Skin.canvas_shade = Color.FromArgb(80, 0, 0, 0);
    }
# ---------- end c_script ----------
length = Panel(getsection.length)
height = Panel(getsection.height_2)
xy = Panel(getsection.coordinates)
as = Panel(getsection.areas)
ds = Panel(getsection.depth_of_rebars)
width = Panel(getsection.width_2)

# ----
# Working components
# Cross-section analysis
getsection_2 = Cluster()  # -> cross_section_in_middle_of_element, length, width_2, height_2, coordinates, areas, depth_of_rebars

getsection_3 = Cluster(beam_geometries=brep, reinforcment_bars=brep_2)  # -> cross_section_in_middle_of_element, length, width_2, height_2, coordinates, areas, depth_of_rebars

list = ValueList({"Uniform distributed load": 0, "Point load in middle or end(cantilever)": 1}, selected="Uniform distributed load")
list_2 = ValueList({"Simply supported in both ends": 0, "Cantilever": 1}, selected="Simply supported in both ends")
load_kn_m = Panel("15")
load_kn = Panel("40")
division = Division(A=getsection_3.length, B=1000)
loadcalc = LoadCalculation(Loads=load_kn_m, LoadType=list, Support=list_2, Lengths=division)  # -> Mmax, Vmax, LoadSet; inputs Loads: Int32, LoadType: Int32, Support: Int32, Lengths: Int32
# ---------- loadcalc: Python ----------
"""
Applied load calculation. Calculates the moment and shear forces in a beam based on the support conditions
-----
FireSim made by Thomas Dyhr, DTU.BYG

    Args:
        Loads: Applied load on beams [kN/m] or [kN] - Default: 40
        LoadType: Load type - (0=uniform distributed | 1=point load in middle or end(cantilever)) - Default: 0
        Support: Support conditions - (0=Simply supported both ends | 1=Cantilever) - Default: 0
        Lengths: Length of beams [m] - Default: 5
    Returns:
        Mmax: Resulting moment [kNm]
        Vmax: Resulting shear force [kN]
        LoadSet: Load settings as list
"""

ghenv.Component.Name = 'Load Calculation'
ghenv.Component.NickName = 'LoadCalc'
ghenv.Component.Message = 'Load Calculation v.002'

# Import classes

## Calculations ##

# Defaults

defLoads = 40
defLoadType = 0 
defSupport = 0
defLengths = 5

if not Loads:
    Loads = defLoads
if not LoadType:
    LoadType = defLoadType
if not Support:
    Support = defSupport
if not Lengths:
    Lengths = defLengths


#Max Moment force
if Support == 0:
    if LoadType == 0:
        Mmax = 1/8*Loads*Lengths*Lengths
    elif LoadType == 1:
        Mmax = 1/4*Loads*Lengths
elif Support == 1:
    if LoadType == 0:
        Mmax = -1/2*Loads*Lengths*Lengths
    elif LoadType == 1:
        Mmax = -Loads*Lengths

#Max Shear force
if Support == 0:
    if LoadType == 0:
        Vmax = 1/2*Loads*Lengths
    elif LoadType == 1:
        Vmax = 1/2*Loads
elif Support == 1:
    if LoadType == 0:
        Vmax = Loads*Lengths
    elif LoadType == 1:
        Vmax = Loads

Mmax = round(Mmax,2)
Vmax = round(Vmax,2)
LoadSet = [Loads , LoadType , Support]
# ---------- end loadcalc ----------
panel_2 = Panel(loadcalc.Vmax)
panel_3 = Panel(loadcalc.Mmax)

pdecon = Deconstruct(Point=getsection_3.coordinates)  # -> flatten(XComponent), flatten(YComponent), ZComponent
definesection = DefineCrossSectionGeometry(
    Width=number_slider_2,
    Height=number_slider_3,
    RebarsTop=mainrebars,
    RebarsBot=mainrebars_2,
    ShearBars=shearrebars,
    Cover=Slider(30, range=0..100))  # -> Section, AreaTop, xyTop, dsTop, AreaBot, xyBot, dsBot; inputs Width: Int32, Height: Int32, RebarsTop: list of Int32, RebarsBot: list of Int32, ShearBars: list of Int32, Cover: Int32
# ---------- definesection: Python ----------
"""
Cross-section geometry. Returns the geometry of the cross-section based on input values
-----
FireSim made by Thomas Dyhr, DTU.BYG

    Args:
        Width: Widht of cross-section [mm] - Default: 250
        Height: Height of cross-section [mm] - Default: 500
        RebarsTop: Input settings for rebars in "top" of cross-section - Default: [16,4]
        RebarsBot: Input settings for rebars in "bot" of cross-section - Default: [16,4]
        ShearBars: Input settings for shear rebars in cross-section - Default: [10,100]
        Cover: Cover thickness [mm] (From concrete edge to shear rebar's outer edge) - Default: 40 
    Returns:
        Section: Conctains a list of curves that determines the cross-section geometry
        AreaTop: Area of each rebar in the top layer [mm2]
        xyTop: Local xy-coordinates of half of the rebars in top of the cross-section (Due to symmetry)
        dsTop: Distance from bot edge to center of top rebars [mm]
        AreaBot: Area of each rebar in the bottom layer [mm2]
        xyBot: Local xy-coordinates of half of the rebars in bottom of the cross-section (Due to symmetry)
        dsBot: Distance from top edge to center of bottom rebars [mm]
"""

ghenv.Component.Name = 'Define Cross-Section Geometry'
ghenv.Component.NickName = 'DefineSection'
ghenv.Component.Message = 'Define Cross-Section Geometry v.007'

#Import classes
import rhinoscriptsyntax as rs

## Code ##

#Defaults
defWidth = 250
defHeight = 500
defRebarsTop = [16,4]
defRebarsBot = [16,4]
defShearBars = [10,100]
defCover = 40

if not Width:
    Width = defWidth
if not Height:
    Height = defHeight
if not RebarsTop:
    RebarsTop = defRebarsTop
if not RebarsBot:
    RebarsBot = defRebarsBot
if not ShearBars:
    ShearBars = defShearBars
if not Cover:
    Cover = defCover

def Geo(Width,Height,RebarsTop,RebarsBot,ShearBars,Cover):
    #Create concrete section
    ConSec = rs.AddRectangle( (0,0,0) , Width, Height)
    explodeSec = rs.ExplodeCurves(ConSec)
    TopEdgeMid = rs.CurveMidPoint(explodeSec[2])
    BotEdgeMid = rs.CurveMidPoint(explodeSec[0])
    
    #Offsets for shear rebar position
    ShearOuter = rs.OffsetCurve(ConSec, TopEdgeMid , Cover)
    
    #explode = rs.ExplodeCurves(ShearOuter)
    #radius = 20
    #fill = rs.CurveFilletPoints(explode[0],explode[1],radius)
    #fillet1 = rs.AddFilletCurve(explode[0],explode[1],radius)
    #fillet2 = rs.AddFilletCurve(explode[1],explode[2],radius)
    #fillet3 = rs.AddFilletCurve(explode[2],explode[3],radius)
    #fillet4 = rs.AddFilletCurve(explode[3],explode[0],radius)
    #fillet = [fillet1,fillet2,fillet3,fillet4]
    
    ShearInner = rs.OffsetCurve(ConSec, TopEdgeMid, Cover+ShearBars[0])
    
    explodeInner = rs.ExplodeCurves(ShearInner)
    
    #Creating Top bars
    TopLine = rs.OffsetCurve(explodeInner[2], BotEdgeMid, RebarsTop[0]/2)
    TopLine = rs.ExtendCurveLength(TopLine, 0, 2, -RebarsTop[0]/2)
    DivTop = rs.DivideCurve(TopLine,RebarsTop[1]-1)
    TopBars = []
    for i in range(len(DivTop)):
        TopBars.append(rs.AddCircle(DivTop[i],RebarsTop[0]/2))
    TopLineMid = rs.CurveMidPoint(TopLine)
    #ds to Top bars
    dsTop = rs.Distance(TopLineMid,BotEdgeMid)
    
    #Creating Bot bars
    BotLine = rs.OffsetCurve(explodeInner[0], TopLineMid, RebarsBot[0]/2)
    BotLine = rs.ExtendCurveLength(BotLine, 0, 2, -RebarsBot[0]/2)
    DivBot = rs.DivideCurve(BotLine,RebarsBot[1]-1)
    BotBars = []
    for i in range(len(DivBot)):
        BotBars.append(rs.AddCircle(DivBot[i],RebarsBot[0]/2))
    BotLineMid = rs.CurveMidPoint(BotLine)
    #ds to bot bars
    dsBot = rs.Distance(BotLineMid,TopEdgeMid)
    
    #Output
    Section = [ConSec]
    for i in range(len(TopBars)):
        Section.append(TopBars[i])
    for i in range(len(BotBars)):
        Section.append(BotBars[i])
    Section.append(ShearOuter[0])
    Section.append(ShearInner[0])
    
    AreaTop = []
    for i in TopBars:
        AreaTop.append(int(rs.Area(i)))
    
    xyTop = []
    DivTop.reverse()
    for i in range(int(round(len(DivTop)))):
        xyTop.append(DivTop[i])
    
    AreaBot = []
    for i in BotBars:
        AreaBot.append(int(rs.Area(i)))
    
    xyBot = []
    for i in range(int(round(len(DivBot)))):
        xyBot.append(DivBot[i])
    
    return Section,AreaTop,xyTop,dsTop,AreaBot,xyBot,dsBot

Section,AreaTop,xyTop,dsTop,AreaBot,xyBot,dsBot = Geo(Width,Height,RebarsTop,RebarsBot,ShearBars,Cover)
# ---------- end definesection ----------
panel_4 = Panel(pdecon.XComponent)
panel_5 = Panel(pdecon.YComponent)

# ----
# Steel Strength
steelstr = SteelStrength()  # -> Fsu, Fsd, FsHot, FsCold, εs_min; inputs A: list, fyk: Int32, Es: Int32, ξsHot: list, ξsCold: list
# ---------- steelstr: Python ----------
"""
Reinforcement strength in case of fire. Calculates the sectional forces of reinforcement affected by higher temperatures due to fire
-----
FireSim made by Thomas Dyhr, DTU.BYG

    Args:
        A: List of cross-sectional areas of each reinforcement bar in the section [mm2]
        fyk: Characteristic steel strength at 20C in [MPa] - Default: 550
        Es: Steel E-modulus at 20C in [GPa] - Default: 210
        γm: Partial factor
        ξsHot: List of Deterioration factors for half of the reinforcement bars in the section due to symmetry - HOT condition
        ξsCold: List of Deterioration factors for half of the reinforcement bars in the section due to symmetry - COLD condition
    Returns:
        Fsu: Ultimate force of each reinforcement bar in the section [kN]
        Fsd: Design force of each reinforcement bar in the section [kN]
        FsHot: Resulting force of each reinforcement bar in the section due to fire - HOT condition [kN]
        FsCold: Resulting force of each reinforcement bar in the section due to fire - COLD condition [kN]
        εs_min: Minimum strain of the steel
"""

ghenv.Component.Name = 'Steel Strength'
ghenv.Component.NickName = 'SteelStr'
ghenv.Component.Message = 'Steel Strength v.008'

# Import classes
import ghpythonlib.components as ghcomp

# Defaults
deffyk=550
defEs=210

if not fyk:
    fyk = deffyk
if not Es:
    Es = defEs

## Calculations ##

# Characteristic strength at 20C
Fsu = [a * int(fyk)/1000 for a in A]

# Characteristic strength at 20C
Fsd = [a * int(fyk)/1000/float(γm) for a in A]

#Determine if there is an odd or even number of rebars (modulus=0 means even)
mod = ghcomp.Modulus(len(A),2)

#Extend list of degredation factors to fit the number of rebars
if mod==0:
    XiHOT=ghcomp.InsertItems(ξsHot,list(reversed(ξsHot)),len(ξsHot))
    XiCOLD=ghcomp.InsertItems(ξsCold,list(reversed(ξsCold)),len(ξsCold))
else:
    XiHOT=ghcomp.InsertItems(ξsHot,ξsHot,len(ξsHot))
    XiHOT.pop()
    XiCOLD=ghcomp.InsertItems(ξsCold,ξsCold,len(ξsCold))
    XiCOLD.pop()

# Multiply initial strength with degredation factor
FsHot = []
FsCold = []
for i in range(0, len(Fsu)):   
     FsHot.append(round(Fsu[i]*XiHOT[i],2))
     FsCold.append(round(Fsu[i]*XiCOLD[i],2))

#Minimum strain of steel
εs_min = round(fyk/(Es*1000)*100+0.2,3)
# ---------- end steelstr ----------

steel_strength = Steel_Strength()  # -> Fsu, Fs, εs_min; inputs Area: list, fs: Int32, Es: Int32, ξs: list; disabled
# ---------- steel_strength: Python ----------
"""
Reinforcement strength in case of fire. Calculates the sectional forces of reinforcement affected by higher temperatures due to fire
-----
FireSim made by Thomas Dyhr, DTU.BYG

    Args:
        Area: List of cross-sectional areas of each reinforcement bar in the section in [mm2]
        fs: Steel strength at 20C in [MPa]
        Es: Steel E-modulus at 20C in [GPa]
        ξs: List of Deterioration factors for half of the reinforcement bars in the section due to symmetry
    Returns:
        Fsu: Ultimate force of each reinforcement bar in the section [kN]
        Fs: Resulting force of each reinforcement bar in the section due to fire [kN]
        εs_min: Minimum strain of the steel
"""

ghenv.Component.Name = 'Steel_Strength'
ghenv.Component.NickName = 'Steel Strength'
ghenv.Component.Message = 'Steel Strength v.003'

# Import classes
import ghpythonlib.components as ghcomp

## Calculations ##

# Initial strength at 20C
Fsu = [a * int(fs)/1000 for a in Area]

#Determine if there is an odd or even number of rebars (modulus=0 means even)
mod = ghcomp.Modulus(len(Area),2)

#Extend list of degredation factors to fit the number of rebars
if mod==0:
    XiT=ghcomp.InsertItems(ξs,list(reversed(ξs)),len(ξs))
else:
    XiT=ghcomp.InsertItems(ξs,ξs,len(ξs))
    XiT.pop()

# Multiply initial strength with degredation factor
Fs = []                        
for i in range(0, len(Fsu)):   
     Fs.append(round(Fsu[i]*XiT[i],2))

#Minimum strain of steel
εs_min = round(fs/(Es*1000)*100+0.2,3)
# ---------- end steel_strength ----------
steel_strength_2 = Steel_Strength()  # -> Fsu, Fs; inputs Area: list, Xi_T: list; disabled
# ---------- steel_strength_2: Python ----------
"""
FireSim - Reinforcement strength in case of fire. Calculates the sectional forces of reinforcement affected by higher temperatures due to fire
-----
FireSim made by Thomas Dyhr, DTU.BYG

    Args:
        Area: List of cross-sectional areas of each reinforcement bar in the section in [mm2]
        Str: Steel strength at 20C in [MPa]
        Xi_T: List of Deterioration factors for half of the reinforcement bars in the section due to symmetry
    Returns:
        Fsu: Ultimate force of each reinforcement bar in the section [kN]
        Fs: Resulting force of each reinforcement bar in the section due to fire [kN]
"""

ghenv.Component.Name = 'Steel_Strength'
ghenv.Component.NickName = 'Steel Strength'
ghenv.Component.Message = 'Steel Strength v.002'

# Import classes
import ghpythonlib.components as ghcomp

## Calculations ##

# Initial strength at 20C
Fsu = [a * int(Str)/1000 for a in Area]

#Determine if there is an odd or even number of rebars (modulus=0 means even)
mod = ghcomp.Modulus(len(Area),2)

#Extend list of degredation factors to fit the number of rebars
if mod==0:
    XiT=ghcomp.InsertItems(Xi_T,list(reversed(Xi_T)),len(Xi_T))
else:
    XiT=ghcomp.InsertItems(Xi_T,Xi_T,len(Xi_T))
    XiT.pop()

# Multiply initial strength with degredation factor
Fs = []                        
for i in range(0, len(Fsu)):   
     Fs.append(round(Fsu[i]*XiT[i],2))
# ---------- end steel_strength_2 ----------
steel_strength_3 = Steel_Strength()  # -> Fsu, Fsd, Fs, εs_min; inputs A: list, fyk: Int32, Es: Int32, ξs: list; disabled
# ---------- steel_strength_3: Python ----------
"""
Reinforcement strength in case of fire. Calculates the sectional forces of reinforcement affected by higher temperatures due to fire
-----
FireSim made by Thomas Dyhr, DTU.BYG

    Args:
        A: List of cross-sectional areas of each reinforcement bar in the section in [mm2]
        fyk: Characteristic steel strength at 20C in [MPa]
        Es: Steel E-modulus at 20C in [GPa]
        γm: Partial factor
        ξs: List of Deterioration factors for half of the reinforcement bars in the section due to symmetry
    Returns:
        Fsu: Ultimate force of each reinforcement bar in the section [kN]
        Fsd: Design force of each reinforcement bar in the section [kN]
        Fs: Resulting force of each reinforcement bar in the section due to fire [kN]
        εs_min: Minimum strain of the steel
"""

ghenv.Component.Name = 'Steel_Strength'
ghenv.Component.NickName = 'Steel Strength'
ghenv.Component.Message = 'Steel Strength v.004'

# Import classes
import ghpythonlib.components as ghcomp

## Calculations ##

# Characteristic strength at 20C
Fsu = [a * int(fyk)/1000 for a in A]

# Characteristic strength at 20C
Fsd = [a * int(fyk)/1000/float(γm) for a in A]

#Determine if there is an odd or even number of rebars (modulus=0 means even)
mod = ghcomp.Modulus(len(A),2)

#Extend list of degredation factors to fit the number of rebars
if mod==0:
    XiT=ghcomp.InsertItems(ξs,list(reversed(ξs)),len(ξs))
else:
    XiT=ghcomp.InsertItems(ξs,ξs,len(ξs))
    XiT.pop()

# Multiply initial strength with degredation factor
Fs = []                        
for i in range(0, len(Fsu)):   
     Fs.append(round(Fsu[i]*XiT[i],2))

#Minimum strain of steel
εs_min = round(fyk/(Es*1000)*100+0.2,3)
# ---------- end steel_strength_3 ----------
steel_strength_4 = Steel_Strength()  # -> Fs; inputs Area: list, Xi_T: list; disabled
# ---------- steel_strength_4: Python ----------
"""
FireSim - Reinforcement strength in case of fire. Calculates the sectional force of reinforcement affected by higher temperatures due to fire
-----
FireSim made by Thomas Dyhr, DTU.BYG

    Args:
        Area: List of cross-sectional areas of each reinforcement bar in the section in [mm2]
        Str: Steel strength at 20C in [MPa]
        Xi_T: List of Deterioration factors for half of the reinforcement bars in the section due to symmetry
    Returns:
        Fs: Resulting strength of each reinforcement bar [kN]
"""

ghenv.Component.Name = 'Steel_Strength'
ghenv.Component.NickName = 'Steel Strength'
ghenv.Component.Message = 'Steel Strength v.001'

# Import classes
import ghpythonlib.components as ghcomp

## Calculations ##

# Initial strength at 20C
Fsu0 = [a * int(Str)/1000 for a in Area]

#Determine if there is an odd or even number of rebars (modulus=0 means even)
mod = ghcomp.Modulus(len(Area),2)

#Extend list of degredation factors to fit the number of rebars
if mod==0:
    XiT=ghcomp.InsertItems(Xi_T,list(reversed(Xi_T)),len(Xi_T))
else:
    XiT=ghcomp.InsertItems(Xi_T,Xi_T,len(Xi_T))
    XiT.pop()

# Multiply initial strength with degredation factor
Fs = []                        
for i in range(0, len(Fsu0)):   
     Fs.append(round(Fsu0[i]*XiT[i],2))
# ---------- end steel_strength_4 ----------
tempanalysis = TemperatureAnalysis(
    cross_section=getsection_3.cross_section_in_middle_of_element,
    concrete_type=contype,
    sides_exposed=exposed,
    section_width=getsection_3.width_2,
    section_height=getsection_3.height_2,
    x_coordinates=panel_4,
    y_coordinates=panel_5,
    time_step=number_slider,
    temperature_display=toggle)  # -> temperature_at_x_y, average_deterioration_hot, average_deterioration_cold, deterioration_at_midpoint, deterioration_at_midpoint_2, stress_distribution_factor, stress_distribution_factor_2, coloured_mesh
geo = Geometry(definesection.Section)
pdecon_2 = Deconstruct(Point=definesection.xyBot)  # -> flatten(XComponent), flatten(YComponent), ZComponent
pdecon_3 = Deconstruct(Point=[definesection.xyBot, definesection.xyTop])  # -> flatten(XComponent), flatten(YComponent), ZComponent
pdecon_4 = Deconstruct(Point=definesection.xyTop)  # -> flatten(XComponent), flatten(YComponent), ZComponent

# ----
# Steel Deterioration
rebartype_2 = RebarType({"Hot rolled bars": 0, "Cold worked bars": 4, "Cold worked prestressing steel": 8, "Quenched and tempered, 1500 MPa": 12, "Quenched and self-tempered, 550 MPa": 16}, selected="Hot rolled bars")
temp_c = Panel("""621
503""")
list_3 = ValueList({"0.2% stress": 1, "2.0% stress": 2}, selected="0.2% stress")
steelreduction = SteelReductionFactors(rebar_type=rebartype_2, stress_type=list_3, temperature_in_xy_point_s=temp_c)  # -> steel_deterioration, steel_deterioration_2

panel_6 = Panel(pdecon_2.XComponent)
panel_7 = Panel(pdecon_2.YComponent)
panel_8 = Panel(pdecon_3.XComponent)
panel_9 = Panel(pdecon_3.YComponent)
panel_10 = Panel(pdecon_4.XComponent)
panel_11 = Panel(pdecon_4.YComponent)
steelreduction_2 = SteelReductionFactors(rebar_type=rebartype, stress_type=stresstype, temperature_in_xy_point_s=tempanalysis.temperature_at_x_y)  # -> steel_deterioration, steel_deterioration_2
tempanalysis_2 = TemperatureAnalysis(
    cross_section=definesection.Section,
    concrete_type=contype,
    sides_exposed=exposed,
    section_width=number_slider_2,
    section_height=number_slider_3,
    x_coordinates=panel_6,
    y_coordinates=panel_7,
    time_step=number_slider,
    temperature_display=toggle)  # -> temperature_at_x_y, average_deterioration_hot, average_deterioration_cold, deterioration_at_midpoint, deterioration_at_midpoint_2, stress_distribution_factor, stress_distribution_factor_2, coloured_mesh
tempanalysis_3 = TemperatureAnalysis(
    cross_section=definesection.Section,
    concrete_type=contype,
    sides_exposed=exposed,
    section_width=number_slider_2,
    section_height=number_slider_3,
    x_coordinates=panel_8,
    y_coordinates=panel_9,
    time_step=number_slider,
    temperature_display=toggle)  # -> temperature_at_x_y, average_deterioration_hot, average_deterioration_cold, deterioration_at_midpoint, deterioration_at_midpoint_2, stress_distribution_factor, stress_distribution_factor_2, coloured_mesh
tempanalysis_4 = TemperatureAnalysis(
    cross_section=definesection.Section,
    concrete_type=contype,
    sides_exposed=exposed,
    section_width=number_slider_2,
    section_height=number_slider_3,
    x_coordinates=panel_10,
    y_coordinates=panel_11,
    time_step=number_slider,
    temperature_display=toggle)  # -> temperature_at_x_y, average_deterioration_hot, average_deterioration_cold, deterioration_at_midpoint, deterioration_at_midpoint_2, stress_distribution_factor, stress_distribution_factor_2, coloured_mesh

ma = MassAddition(Input=steelreduction_2.steel_deterioration)  # -> Result, PartialResults
lng = ListLength(List=steelreduction_2.steel_deterioration)
division_2 = Division(A=ma.Result, B=lng)

steelstr_2 = SteelStrength(
    A=getsection_3.areas,
    fyk=yield_strength_of_steel_20c_mpa,
    Es=e_modulus_of_steel_20c_gpa,
    γm=partial_factor,
    ξsHot=steelreduction_2.steel_deterioration,
    ξsCold=steelreduction_2.steel_deterioration_2)  # -> Fsu, Fsd, FsHot, FsCold, εs_min; inputs A: list, fyk: Int32, Es: Int32, ξsHot: list, ξsCold: list; same code as steelstr
ma_2 = MassAddition(Input=getsection_3.areas)  # -> Result, PartialResults
steelreduction_3 = SteelReductionFactors(rebar_type=rebartype, stress_type=stresstype, temperature_in_xy_point_s=tempanalysis_3.temperature_at_x_y)  # -> steel_deterioration, steel_deterioration_2
panel_12 = Panel(tempanalysis_2.temperature_at_x_y)
panel_13 = Panel(tempanalysis_4.temperature_at_x_y)
posmomentcapacity = PositiveMomentCapacity(
    Fsu=steelstr_2.Fsu,
    Fsd=steelstr_2.Fsd,
    FsHot=steelstr_2.FsHot,
    FsCold=steelstr_2.FsCold,
    εs_min=steelstr_2.εs_min,
    fcc=concrete_strength_20c_mpa,
    W=getsection_3.width_2,
    ds=getsection_3.depth_of_rebars,
    ξcMHot=tempanalysis.deterioration_at_midpoint,
    ξcMCold=tempanalysis.deterioration_at_midpoint_2,
    ηHot=tempanalysis.stress_distribution_factor,
    ηCold=tempanalysis.stress_distribution_factor_2)  # -> Md, Mstart, Mhot, Mcold, Info; inputs Fsu: list of Int32, Fsd: list of Int32, FsHot: list, FsCold: list
# ---------- posmomentcapacity: Python ----------
"""
Positive moment capacity in case of fire. Calculates the positive moment capacity of a beam with reinforcement in the bottom part of the section
-----
FireSim made by Thomas Dyhr, DTU.BYG

    Args:
        Fsu: Ultimate force of each reinforcement bar in the section [kN]
        Fsd: Design force of each reinforcement bar in the section [kN]
        FsHot: Resulting force of each reinforcement bar in the section due to fire - HOT condition [kN]
        FsCold: Resulting force of each reinforcement bar in the section due to fire - COLD condition [kN]
        εs_min: Minimum strain of the steel
        fcc: Concrete strength at 20C in [MPa]
        W: Width of cross-section [mm]
        ds: Depth of steel layer from compressed edge [mm]
        ξcMHot: Deterioration factor of concrete in mid section - HOT condition
        ξcMCold: Deterioration factor of concrete in mid section - COLD condition
        ηHot: Stress Distribution Factor - HOT condition
        ηCold: Stress Distribution Factor - COLD condition
    Returns:
        Md: Positive moment capacity - Design Value [kNm]
        Mstart: Positive moment capacity - Start of Fire [kNm]
        Mhot: Positive moment capacity - HOT condition [kNm]
        Mcold: Positive moment capacity - COLD condition [kNm]
        Info: Check if cross-section is over-reinforced
"""

ghenv.Component.Name = 'Positive Moment Capacity'
ghenv.Component.NickName = 'PosMomentCapacity'
ghenv.Component.Message = 'Positive Moment Capacity v.006'

# Import classes

# Defaults
deffcc=30
defW=250
defξcMHot=1
defξcMCold=1
defηHot=1
defηCold=1
defy=1
defds=1

if not fcc:
    fcc = deffcc
if not W:
    W = defW
if not ξcMHot:
    ξcMHot = defξcMHot
if not ξcMCold:
    ξcMCold = defξcMCold
if not ηHot:
    ηHot = defηHot
if not ηCold:
    ηCold = defηCold
if not ds:
    ds = defds

## Calculations ##

FsdTOT = sum(Fsd)
FsuTOT = sum(Fsu)
FsHTOT = sum(FsHot)
FsCTOT = sum(FsCold)

def MomentCalc(FsTOT,W,n,Xic,fcc,ds):
    y = round(FsTOT/(W*n*Xic*int(fcc))*1000,2) #Depth of compression zone
    Moment = round(FsTOT*(ds-y/2)/1000,2) #Moment
    return Moment,y

#Design values
Md,yd = MomentCalc(FsdTOT,W,1,1,fcc,ds)

#Start of fire
Mstart,ystart = MomentCalc(FsuTOT,W,1,1,fcc,ds)

#During Fire
Mhot,yhot = MomentCalc(FsHTOT,W,ηHot,ξcMHot,fcc,ds)

#After Fire
Mcold,ycold = MomentCalc(FsCTOT,W,ηCold,ξcMCold,fcc,ds)

#Check for over-reinforced section
def StrainCheck(ds,y,XicM):
    if not y:
        y = defy
    strain = round((ds-(5/4)*y)/((5/4)*y)*(0.35/XicM),3)
    return strain

εsDES = StrainCheck(ds,yd,1)
εsULT = StrainCheck(ds,ystart,1)
εsHOT = StrainCheck(ds,yhot,ξcMHot)
εsCOLD = StrainCheck(ds,ycold,ξcMHot)

if εsDES > εs_min and εsULT > εs_min and εsHOT > εs_min and εsCOLD > εs_min :
    Info = "Cross-section is NOT over-reinforced in either of the: Design, Ultimate, HOT or COLD conditions"
elif εsDES < εs_min or εsULT < εs_min or εsHOT < εs_min or εsCOLD < εs_min :
    Info = "NB! Cross-section IS over-reinforced !!"
# ---------- end posmomentcapacity ----------
steelreduction_4 = SteelReductionFactors(rebar_type=rebartype, stress_type=stresstype, temperature_in_xy_point_s=tempanalysis_2.temperature_at_x_y)  # -> steel_deterioration, steel_deterioration_2
beamdeflection = DeflectionAnalysisOfBeam_2(
    initial_beams=brep,
    concrete_strength=concrete_strength_20c_mpa,
    area_of_steel=ma_2.Result,
    e_modulus_steel=e_modulus_of_steel_20c_gpa,
    average_concrete_deterioration=tempanalysis_3.average_deterioration_hot,
    average_steel_deterioration=division_2,
    loadsettings=loadcalc.LoadSet,
    multfactor=Slider(16, range=0..100))  # -> geometry, deflection
steelreduction_5 = SteelReductionFactors(rebar_type=rebartype, stress_type=stresstype, temperature_in_xy_point_s=tempanalysis_4.temperature_at_x_y)  # -> steel_deterioration, steel_deterioration_2

# ----
# Moment Capacity
posmomentcapacity_2 = PositiveMomentCapacity()  # -> Md, Mstart, Mhot, Mcold, Info; inputs Fsu: list of Int32, Fsd: list of Int32, FsHot: list, FsCold: list; same code as posmomentcapacity
negmomentcapacity = NegativeMomentCapacity()  # -> Md, Mstart, Mhot, Mcold, Info; inputs Fsu: list of Int32, Fsd: list of Int32, FsHot: list, FsCold: list
# ---------- negmomentcapacity: Python ----------
"""
Negative moment capacity in case of fire. Calculates the negative moment capacity of a cantilever beam with reinforcement in the top part of the section
-----
FireSim made by Thomas Dyhr, DTU.BYG

    Args:
        Fsu: Ultimate force of each reinforcement bar in the section [kN]
        Fsd: Design force of each reinforcement bar in the section [kN]
        FsHot: Resulting force of each reinforcement bar in the section due to fire - HOT condition [kN]
        FsCold: Resulting force of each reinforcement bar in the section due to fire - COLD condition [kN]
        εs_min: Minimum strain of the steel
        fcc: Concrete strength at 20C in [MPa] - Default: 30
        W: Width of cross-section [mm] - Default: 250
        ds: Depth of steel layer from compressed edge [mm]
        ξcMHot: Deterioration factor of concrete in mid section - HOT condition
        ξcMCold: Deterioration factor of concrete in mid section - COLD condition
        ηHot: Stress Distribution Factor - HOT condition
        ηCold: Stress Distribution Factor - COLD condition
    Returns:
        Md: Positive moment capacity - Design Value [kNm]
        Mstart: Positive moment capacity - Start of Fire [kNm]
        Mhot: Positive moment capacity - HOT condition [kNm]
        Mcold: Positive moment capacity - COLD condition [kNm]
        Info: Check if cross-section is over-reinforced
"""

ghenv.Component.Name = 'Negative Moment Capacity'
ghenv.Component.NickName = 'NegMomentCapacity'
ghenv.Component.Message = 'Negative Moment Capacity v.002'

# Import classes

# Defaults
deffcc=30
defW=250
defξcMHot=1
defξcMCold=1
defηHot=1
defηCold=1
defy=1
defds=1

if not fcc:
    fcc = deffcc
if not W:
    W = defW
if not ξcMHot:
    ξcMHot = defξcMHot
if not ξcMCold:
    ξcMCold = defξcMCold
if not ηHot:
    ηHot = defηHot
if not ηCold:
    ηCold = defηCold
if not ds:
    ds = defds

## Calculations ##

FsdTOT = sum(Fsd)
FsuTOT = sum(Fsu)
FsHTOT = sum(FsHot)
FsCTOT = sum(FsCold)

def MomentCalc(FsTOT,W,n,XicM,fcc,ds):
    y = round(FsTOT/(W*n*XicM*int(fcc))*1000,2) #Depth of compression zone
    Moment = round(FsTOT*(ds-(W/2)*(1-n)-y/2)/1000,2) #Moment
    return Moment,y

#Design values
Md,yd = MomentCalc(FsdTOT,W,1,1,fcc,ds)

#Start of fire
Mstart,ystart = MomentCalc(FsuTOT,W,1,1,fcc,ds)

#During Fire
Mhot,yhot = MomentCalc(FsHTOT,W,ηHot,ξcMHot,fcc,ds)

#After Fire
Mcold,ycold = MomentCalc(FsCTOT,W,ηCold,ξcMCold,fcc,ds)

#Check for over-reinforced section
def StrainCheck(ds,W,n,y,XicM):
    if not y:
        y = defy
    strain = round((ds-(W/2)*(1-n)-(5/4)*y)/((5/4)*y)*(0.35/XicM),3)
    return strain

εsDES = StrainCheck(ds,W,1,yd,1)
εsULT = StrainCheck(ds,W,1,ystart,1)
εsHOT = StrainCheck(ds,W,ηHot,yhot,ξcMHot)
εsCOLD = StrainCheck(ds,W,ηCold,ycold,ξcMHot)

if εsDES > εs_min and εsULT > εs_min and εsHOT > εs_min and εsCOLD > εs_min :
    Info = "Cross-section is NOT over-reinforced in either of the: Design, Ultimate, HOT or COLD conditions"
elif εsDES < εs_min or εsULT < εs_min or εsHOT < εs_min or εsCOLD < εs_min :
    Info = "NB! Cross-section IS over-reinforced !!"
# ---------- end negmomentcapacity ----------

ma_3 = MassAddition(Input=steelreduction_3.steel_deterioration)  # -> Result, PartialResults
lng_2 = ListLength(List=steelreduction_3.steel_deterioration)
division_3 = Division(A=ma_3.Result, B=lng_2)

ma_4 = MassAddition(Input=steelreduction_3.steel_deterioration_2)  # -> Result, PartialResults
lng_3 = ListLength(List=steelreduction_3.steel_deterioration_2)
division_4 = Division(A=ma_4.Result, B=lng_3)

steelstr_3 = SteelStrength(
    A=definesection.AreaBot,
    fyk=yield_strength_of_steel_20c_mpa,
    Es=e_modulus_of_steel_20c_gpa,
    γm=partial_factor,
    ξsHot=steelreduction_4.steel_deterioration,
    ξsCold=steelreduction_4.steel_deterioration_2)  # -> Fsu, Fsd, FsHot, FsCold, εs_min; inputs A: list, fyk: Int32, Es: Int32, ξsHot: list, ξsCold: list
# ---------- steelstr_3: Python ----------
"""
Reinforcement strength in case of fire. Calculates the sectional forces of reinforcement affected by higher temperatures due to fire
-----
FireSim made by Thomas Dyhr, DTU.BYG

    Args:
        A: List of cross-sectional areas of each reinforcement bar in the section [mm2]
        fyk: Characteristic steel strength at 20C in [MPa] - Default: 550
        Es: Steel E-modulus at 20C in [GPa] - Default: 210
        γm: Partial factor
        ξsHot: List of Deterioration factors - HOT condition
        ξsCold: List of Deterioration factors - COLD condition
    Returns:
        Fsu: Ultimate force of each reinforcement bar in the section [kN]
        Fsd: Design force of each reinforcement bar in the section [kN]
        FsHot: Resulting force of each reinforcement bar in the section due to fire - HOT condition [kN]
        FsCold: Resulting force of each reinforcement bar in the section due to fire - COLD condition [kN]
        εs_min: Minimum strain of the steel
"""

ghenv.Component.Name = 'Steel Strength'
ghenv.Component.NickName = 'SteelStr'
ghenv.Component.Message = 'Steel Strength v.009'

# Import classes
import ghpythonlib.components as ghcomp

# Defaults
deffyk=550
defEs=210

if not fyk:
    fyk = deffyk
if not Es:
    Es = defEs

## Calculations ##

# Characteristic strength at 20C
Fsu = [a * int(fyk)/1000 for a in A]

# Characteristic strength at 20C
Fsd = [a * int(fyk)/1000/float(γm) for a in A]

#Determine if there is an odd or even number of rebars (modulus=0 means even)
mod = ghcomp.Modulus(len(A),2)

# Multiply initial strength with degredation factor
FsHot = []
FsCold = []
for i in range(0, len(Fsu)):   
     FsHot.append(round(Fsu[i]*ξsHot[i],2))
     FsCold.append(round(Fsu[i]*ξsCold[i],2))

#Minimum strain of steel
εs_min = round(fyk/(Es*1000)*100+0.2,3)
# ---------- end steelstr_3 ----------
m_start_knm = Panel(posmomentcapacity.Mstart)
m_hot_knm = Panel(posmomentcapacity.Mhot)
m_cold_knm = Panel(posmomentcapacity.Mcold)
md_knm = Panel(posmomentcapacity.Md)
panel_14 = Panel(posmomentcapacity.Info)
steelstr_4 = SteelStrength(
    A=definesection.AreaTop,
    fyk=yield_strength_of_steel_20c_mpa,
    Es=e_modulus_of_steel_20c_gpa,
    γm=partial_factor,
    ξsHot=steelreduction_5.steel_deterioration,
    ξsCold=steelreduction_5.steel_deterioration_2)  # -> Fsu, Fsd, FsHot, FsCold, εs_min; inputs A: list, fyk: Int32, Es: Int32, ξsHot: list, ξsCold: list; same code as steelstr_3
posmomentcapacity_3 = PositiveMomentCapacity(
    Fsu=steelstr_3.Fsu,
    Fsd=steelstr_3.Fsd,
    FsHot=steelstr_3.FsHot,
    FsCold=steelstr_3.FsCold,
    εs_min=steelstr_3.εs_min,
    fcc=concrete_strength_20c_mpa,
    W=number_slider_2,
    ds=definesection.dsBot,
    ξcMHot=tempanalysis_2.deterioration_at_midpoint,
    ξcMCold=tempanalysis_2.deterioration_at_midpoint_2,
    ηHot=tempanalysis_2.stress_distribution_factor,
    ηCold=tempanalysis_2.stress_distribution_factor_2)  # -> Md, Mstart, Mhot, Mcold, Info; inputs Fsu: list of Int32, Fsd: list of Int32, FsHot: list, FsCold: list; same code as posmomentcapacity
negmomentcapacity_2 = NegativeMomentCapacity(
    Fsu=steelstr_4.Fsu,
    Fsd=steelstr_4.Fsd,
    FsHot=steelstr_4.FsHot,
    FsCold=steelstr_4.FsCold,
    εs_min=steelstr_4.εs_min,
    fcc=concrete_strength_20c_mpa,
    W=number_slider_2,
    ds=definesection.dsTop,
    ξcMHot=tempanalysis_4.deterioration_at_midpoint,
    ξcMCold=tempanalysis_4.deterioration_at_midpoint_2,
    ηHot=tempanalysis_4.stress_distribution_factor,
    ηCold=tempanalysis_4.stress_distribution_factor_2)  # -> Md, Mstart, Mhot, Mcold, Info; inputs Fsu: list of Int32, Fsd: list of Int32, FsHot: list, FsCold: list; same code as negmomentcapacity

# ----
# Deflection analyzis
beamdeflection_2 = DeflectionAnalysisOfBeam()  # -> geometry, deflection

ma_5 = MassAddition(Input=[definesection.AreaTop, definesection.AreaBot])  # -> Result, PartialResults
m_start_knm_2 = Panel(posmomentcapacity_3.Mstart)
m_hot_knm_2 = Panel(posmomentcapacity_3.Mhot)
m_cold_knm_2 = Panel(posmomentcapacity_3.Mcold)
md_knm_2 = Panel(posmomentcapacity_3.Md)
panel_15 = Panel(posmomentcapacity_3.Info)
m_hot_knm_3 = Panel(negmomentcapacity_2.Mhot)
m_start_knm_3 = Panel(negmomentcapacity_2.Mstart)
m_cold_knm_3 = Panel(negmomentcapacity_2.Mcold)
md_knm_3 = Panel(negmomentcapacity_2.Md)
panel_16 = Panel(negmomentcapacity_2.Info)
beamdeflection_3 = DeflectionAnalysisOfBeam_2(
    initial_beams=brep,
    concrete_strength=concrete_strength_20c_mpa,
    area_of_steel=ma_5.Result,
    e_modulus_steel=e_modulus_of_steel_20c_gpa,
    average_concrete_deterioration=tempanalysis_3.average_deterioration_hot,
    average_steel_deterioration=division_3,
    loadsettings=loadcalc.LoadSet,
    multfactor=Slider(27, range=0..100))  # -> geometry, deflection

# ----
# Inputs
list_4 = ValueList({"Hot rolled bars": 0, "Cold worked bars": 4, "Cold worked prestressing steel": 8, "Quenched and tempered, 1500 MPa": 12, "Quenched and self-tempered, 550 MPa": 16}, selected="Hot rolled bars")  # disabled
partial_factor_2 = Panel("1.2")  # disabled
yield_strength_of_steel_20c_mpa_2 = Panel("550")  # disabled
concrete_strength_20c_mpa_2 = Panel("30")  # disabled
opening_factor_m½ = Panel("0.02")  # disabled
fire_load_mj_m² = Panel("200")  # disabled
themal_inertia_ws½_m²c = Panel("400")  # disabled
list_5 = ValueList({"0.2% stress": 1, "2.0% stress": 2}, selected="0.2% stress")  # disabled

xicmhot_2 = Panel("0.9733")  # disabled
n_cold_2 = Panel("0.6201")  # disabled
xicmcold_2 = Panel("0.7160")  # disabled
n_hot_2 = Panel("0.7623")  # disabled
num_5 = Number(xicmhot_2)  # disabled
num_6 = Number(n_cold_2)  # disabled
num_7 = Number(xicmcold_2)  # disabled
num_8 = Number(n_hot_2)  # disabled

temp_c_2 = Panel("""418
197""")  # disabled
e_modulus_of_steel_20c_gpa_2 = Panel("210")  # disabled

# ---- group: Rebars
brep_3 = Brep([<brep referenced from the Rhino model> x4])  # disabled

# ---- group: Beams
brep_4 = Brep(<brep referenced from the Rhino model>)  # disabled

# ----
steelreduction_6 = SteelReductionFactors(rebar_type=list_4, stress_type=list_5, temperature_in_xy_point_s=temp_c_2)  # -> steel_deterioration, steel_deterioration_2; disabled
cluster = Cluster(beam_geometries=brep_4, reinforcment_bars=brep_3)  # -> cross_section_in_middle_of_element, length, width_2, height_2, coordinates, areas, depth_of_rebars; disabled

number_slider_4 = Slider(4, range=0..10)  # disabled
number_slider_5 = Slider(16, range=0..100)  # disabled
mainrebars_3 = MainReinforcement(Size=number_slider_5, Number=number_slider_4)  # -> MainBars; inputs Number: Int32; disabled; same code as mainrebars

number_slider_6 = Slider(4, range=0..10)  # disabled
number_slider_7 = Slider(16, range=0..100)  # disabled
mainrebars_4 = MainReinforcement(Size=number_slider_7, Number=number_slider_6)  # -> MainBars; inputs Number: Int32; disabled; same code as mainrebars

number_slider_8 = Slider(100, range=0..1000)  # disabled
number_slider_9 = Slider(10, range=0..100)  # disabled
shearrebars_2 = ShearReinforcement(Size=number_slider_9, Spacing=number_slider_8)  # -> ShearBars; disabled; same code as shearrebars

number_slider_10 = Slider(500, range=0..1000)  # disabled
# NEGATIVE MOMENT
number_slider_11 = Slider(250, range=0..1000)  # disabled
number_slider_12 = Slider(32, range=0..100)  # disabled
sectiongeometry = CrossSectionGeometry(
    Width=number_slider_11,
    Height=number_slider_10,
    RebarsTop=mainrebars_4,
    RebarsBot=mainrebars_3,
    ShearBars=shearrebars_2,
    Cover=number_slider_12)  # -> Section, AreaTop, xyTop, dsTop, AreaBot, xyBot, dsBot; inputs Width: Int32, Height: Int32, RebarsTop: list of Int32, RebarsBot: list of Int32, ShearBars: list of Int32, Cover: Int32; disabled
# ---------- sectiongeometry: Python ----------
"""
Cross-section geometry. Returns the geometry of the cross-section based on input values
-----
FireSim made by Thomas Dyhr, DTU.BYG

    Args:
        Width: Widht of cross-section [mm]
        Height: Height of cross-section [mm]
        RebarsTop: Input settings for rebars in "top" of cross-section
        RebarsBot: Input settings for rebars in "bot" of cross-section
        ShearBars: Input settings for shear rebars in cross-section
        Cover: Cover thickness [mm] (From concrete edge to shear rebar's outer edge) 
    Returns:
        Section: Conctains a list of curves that determines the cross-section geometry
        AreaTop: Area of each rebar in the top layer [mm2]
        xyTop: Local xy-coordinates of half of the rebars in top of the cross-section (Due to symmetry)
        dsTop: Distance from bot edge to center of top rebars [mm]
        AreaBot: Area of each rebar in the bottom layer [mm2]
        xyBot: Local xy-coordinates of half of the rebars in top of the cross-section (Due to symmetry)
        dsBot: Distance from top edge to center of bottom rebars [mm]
"""

ghenv.Component.Name = 'CrossSection Geometry'
ghenv.Component.NickName = 'SectionGeometry'
ghenv.Component.Message = 'CrossSection Geometry v.005'

#Import classes
import rhinoscriptsyntax as rs

## Code ##

#Defaults
defWidth = 250
defHeight = 500

#if not Size:
#    Size = defSize
#if not Number:
#    Number = defNumber

def Geo(Width,Height,RebarsTop,RebarsBot,ShearBars,Cover):
    #Create concrete section
    ConSec = rs.AddRectangle( (0,0,0) , Width, Height)
    explodeSec = rs.ExplodeCurves(ConSec)
    TopEdgeMid = rs.CurveMidPoint(explodeSec[2])
    BotEdgeMid = rs.CurveMidPoint(explodeSec[0])
    
    #Offsets for shear rebar position
    ShearOuter = rs.OffsetCurve(ConSec, TopEdgeMid , Cover)
    
    #explode = rs.ExplodeCurves(ShearOuter)
    #radius = 20
    #fill = rs.CurveFilletPoints(explode[0],explode[1],radius)
    #fillet1 = rs.AddFilletCurve(explode[0],explode[1],radius)
    #fillet2 = rs.AddFilletCurve(explode[1],explode[2],radius)
    #fillet3 = rs.AddFilletCurve(explode[2],explode[3],radius)
    #fillet4 = rs.AddFilletCurve(explode[3],explode[0],radius)
    #fillet = [fillet1,fillet2,fillet3,fillet4]
    
    ShearInner = rs.OffsetCurve(ConSec, TopEdgeMid, Cover+ShearBars[0])
    
    explodeInner = rs.ExplodeCurves(ShearInner)
    
    #Creating Top bars
    TopLine = rs.OffsetCurve(explodeInner[2], BotEdgeMid, RebarsTop[0]/2)
    TopLine = rs.ExtendCurveLength(TopLine, 0, 2, -RebarsTop[0]/2)
    DivTop = rs.DivideCurve(TopLine,RebarsTop[1]-1)
    TopBars = []
    for i in range(len(DivTop)):
        TopBars.append(rs.AddCircle(DivTop[i],RebarsTop[0]/2))
    TopLineMid = rs.CurveMidPoint(TopLine)
    #ds to Top bars
    dsTop = rs.Distance(TopLineMid,BotEdgeMid)
    
    #Creating Bot bars
    BotLine = rs.OffsetCurve(explodeInner[0], TopLineMid, RebarsBot[0]/2)
    BotLine = rs.ExtendCurveLength(BotLine, 0, 2, -RebarsBot[0]/2)
    DivBot = rs.DivideCurve(BotLine,RebarsBot[1]-1)
    BotBars = []
    for i in range(len(DivBot)):
        BotBars.append(rs.AddCircle(DivBot[i],RebarsBot[0]/2))
    BotLineMid = rs.CurveMidPoint(BotLine)
    #ds to bot bars
    dsBot = rs.Distance(BotLineMid,TopEdgeMid)
    
    #Output
    Section = [ConSec]
    for i in range(len(TopBars)):
        Section.append(TopBars[i])
    for i in range(len(BotBars)):
        Section.append(BotBars[i])
    Section.append(ShearOuter[0])
    Section.append(ShearInner[0])
    
    AreaTop = []
    for i in TopBars:
        AreaTop.append(int(rs.Area(i)))
    
    xyTop = []
    DivTop.reverse()
    for i in range(int(round(len(DivTop)/2))):
        xyTop.append(DivTop[i])
    
    AreaBot = []
    for i in BotBars:
        AreaBot.append(int(rs.Area(i)))
    
    xyBot = []
    for i in range(int(round(len(DivBot)/2))):
        xyBot.append(DivBot[i])
    
    return Section,AreaTop,xyTop,dsTop,AreaBot,xyBot,dsBot

Section,AreaTop,xyTop,dsTop,AreaBot,xyBot,dsBot = Geo(Width,Height,RebarsTop,RebarsBot,ShearBars,Cover)
# ---------- end sectiongeometry ----------
steelstr_5 = SteelStrength(
    A=sectiongeometry.AreaTop,
    fyk=yield_strength_of_steel_20c_mpa_2,
    Es=e_modulus_of_steel_20c_gpa_2,
    γm=partial_factor_2,
    ξsHot=steelreduction_6.steel_deterioration,
    ξsCold=steelreduction_6.steel_deterioration_2)  # -> Fsu, Fsd, FsHot, FsCold, εs_min; inputs A: list, fyk: Int32, Es: Int32, ξsHot: list, ξsCold: list; disabled; same code as steelstr
negmomentcapacity_3 = NegativeMomentCapacity(
    Fsu=steelstr_5.Fsu,
    Fsd=steelstr_5.Fsd,
    FsHot=steelstr_5.FsHot,
    FsCold=steelstr_5.FsCold,
    εs_min=steelstr_5.εs_min,
    fcc=concrete_strength_20c_mpa_2,
    W=number_slider_11,
    ds=sectiongeometry.dsTop,
    ξcMHot=num_5,
    ξcMCold=num_7,
    ηHot=num_8,
    ηCold=num_6)  # -> Md, Mstart, Mhot, Mcold, Info; inputs Fsu: list of Int32, Fsd: list of Int32, FsHot: list, FsCold: list; disabled; same code as negmomentcapacity
m_hot_knm_4 = Panel(negmomentcapacity_3.Mhot)  # disabled
m_cold_knm_4 = Panel(negmomentcapacity_3.Mcold)  # disabled
m_start_knm_4 = Panel(negmomentcapacity_3.Mstart)  # disabled
panel_17 = Panel(negmomentcapacity_3.Info)  # disabled
md_knm_4 = Panel(negmomentcapacity_3.Md)  # disabled

# ==== cluster Cluster
reinforcment_bars = ClusterInput()  # Pick all reinforcement bars (The component will for each beam test which reinforcement bars that are related to that beam)
beam_geometries = ClusterInput()  # Pick all beams (Closed polysurfaces)
brep = Brep(reinforcment_bars)
brep_2 = Brep(beam_geometries)
volume = Volume(Geometry=flatten(brep))  # -> Volume, Centroid
brep_3 = Brep(graft(brep_2))
brepsinc = PointInBreps(Brep=brep_3, Point=volume.Centroid, Strict=False)  # -> Inside, Index
cull = CullPattern(List=brep, CullPattern=brepsinc.Inside)
brep_4 = Brep(brep_3)
brep_5 = Brep(cull)
debrep = DeconstructBrep(Brep=brep_4)  # -> Faces, Edges, Vertices
area = Area(Geometry=debrep.Faces)  # -> Area, Centroid
sort = SortList(Keys=area.Area, ValuesA=debrep.Faces)  # -> Keys, ValuesA
item = ListItem(List=sort.ValuesA, Index=0, Wrap=True)  # -> Item, Item1
volume_2 = Volume(Geometry=brep_4)  # -> Volume, Centroid
area_2 = Area(Geometry=item.Item1)  # -> Area, Centroid
area_3 = Area(Geometry=item.Item)  # -> Area, Centroid
pl_origin = PlaneOrigin(Base=item.Item, Origin=volume_2.Centroid)
sec = BrepPlane(Brep=brep_5, Plane=pl_origin)  # -> flatten(Curves), Points
crv = Curve(sec.Curves)
dist = Distance(PointA=area_3.Centroid, PointB=area_2.Centroid)
darc = DeconstructArc(Arc=crv)  # -> BasePlane, Radius, Angle
sec_2 = BrepPlane(Brep=brep_4, Plane=pl_origin)  # -> Curves, Points
num = Number(simplify(dist))
brepsinc_2 = PointInBreps(Brep=brep_3, Point=darc.BasePlane, Strict=False)  # -> Inside, Index
explode = Explode(Curve=sec_2.Curves, Recursive=True)  # -> Segments, Vertices
cross = Curve(sec_2.Curves)
cullpt = CullDuplicates(Points=explode.Vertices, Tolerance=0.1, CullMode=3)  # -> Points, Indices, Valence
cull_2 = CullPattern(List=darc.BasePlane, CullPattern=brepsinc_2.Inside)
cull_3 = CullPattern(List=darc.Radius, CullPattern=brepsinc_2.Inside)
len = Length(Curve=explode.Segments)
pdecon = Deconstruct(Point=cullpt.Points)  # -> XComponent, YComponent, ZComponent
bnd = Bounds(Numbers=len)
bnd_2 = Bounds(Numbers=pdecon.ZComponent)
expression = Expression(x=cull_3, Expression="x^2*π")
dedomain = DeconstructDomain(Domain=bnd)  # -> Start, End
dedomain_2 = DeconstructDomain(Domain=bnd_2)  # -> Start, End
height = Number(simplify(dedomain.End))
# Geometry analysis
width = Number(simplify(dedomain.Start))
round = Round(Number=expression)  # -> Nearest, Floor, Ceiling
mindex = MemberIndex(Set=pdecon.ZComponent, Member=dedomain_2.Start)  # -> Index, Count
num_2 = Number(simplify(round.Floor))
pt = Point(cull_2)
item_2 = ListItem(List=cullpt.Points, Index=mindex.Index, Wrap=True)
lng = ListLength(List=pt)
item_3 = ListItem(List=item_2, Index=0, Wrap=True)
panel = Panel(num_2)
pt_2 = Point(simplify(item_3))
cps = ClosestPoints(Point=pt_2, Cloud=pt, Count=lng)  # -> ClosestPoint, CPIndex, Distance
mindex_2 = MemberIndex(Set=cullpt.Points, Member=pt_2)  # -> Index, Count
cull_i = CullIndex(List=cullpt.Points, Indices=mindex_2.Index, Wrap=True)
cp = ClosestPoint(Point=pt_2, Cloud=cull_i)  # -> ClosestPoint, CPIndex, Distance
mindex_3 = MemberIndex(Set=cull_i, Member=cp.ClosestPoint)  # -> Index, Count
cull_i_2 = CullIndex(List=cull_i, Indices=mindex_3.Index, Wrap=True)
cp_2 = ClosestPoint(Point=pt_2, Cloud=cull_i_2)  # -> ClosestPoint, CPIndex, Distance
vec2pt = Vector2Pt(PointA=pt_2, PointB=cp.ClosestPoint, Unitize=False)  # -> Vector, Length
vec2pt_2 = Vector2Pt(PointA=pt_2, PointB=cp_2.ClosestPoint, Unitize=False)  # -> Vector, Length
pt_3 = Point(cps.ClosestPoint)
vdis = VectorDisplay(Anchor=pt_2, Vector=vec2pt.Vector)
vdis_2 = VectorDisplay(Anchor=pt_2, Vector=vec2pt_2.Vector)
pl = ConstructPlane(Origin=pt_2, XAxis=vec2pt.Vector, YAxis=vec2pt_2.Vector)
cp_3 = PlaneClosestPoint(Point=pt_3, Plane=pl)  # -> Point, UVPoint, Distance
pdecon_2 = Deconstruct(Point=cp_3.UVPoint)  # -> XComponent, flatten(YComponent), ZComponent
pt_4 = Point(simplify(cp_3.UVPoint))
item_4 = ListItem(List=pdecon_2.YComponent, Index=0, Wrap=True)
subtraction = Subtraction(A=height, B=item_4)  # -> flatten(Result)
ds = Number(subtraction)
crv_2 = Curve(flatten(cross))
crv_3 = Curve(flatten(crv))
crv_4 = Curve([crv_2, crv_3])
cross_section_in_middle_of_element = ClusterOutput(crv_4)  # Returns a list of curves for the cross-section
areas = ClusterOutput(num_2)  # Returns the rebar areas for each beam
coordinates = ClusterOutput(pt_4)  # Returns the local xy- coordinates of half of the rebars in each beam cross-section (Due to symmetry)
depth_of_rebars = ClusterOutput(ds)  # Returns the reinforcement layer depth from the compressed edge of the beam
length = ClusterOutput(num)  # Returns the length of each beam
width_2 = ClusterOutput(width)  # Returns the width of each beam
height_2 = ClusterOutput(height)  # Returns the height of each beam

# ==== cluster SteelReductionFactors: Returns the reduction factors for the steal bars depending on the Rebar Type, Stress Type and Temperature of rebar centre
stress_type = ClusterInput()
temperature_in_xy_point_s = ClusterInput()
rebar_type = ClusterInput()
panel = Panel("C:\Users\Thomas Dyhr\Dropbox\Algoritmic modelling - Grasshopper\Deterioration Constants for Reinforcement Steel.xlsx")
data = Data(temperature_in_xy_point_s)
excelread = ExcelReader(ReadExcelData=Toggle(False), WorkbookPath=panel, WorksheetName="Sheet1")  # -> Exceptions, ExcelData

# ---- group: Connect for change
data_2 = Data(excelread.ExcelData)
data_3 = Data(Tree({0}: ["k", "0", "0", "1", "1", "0", "0", "0.580", "0.520", "0", "0", "0.2", "0.2", "0", "0", "0.213", "0.213", "0", "0", "0.418", "0.437"], {1}: ["T1", "6000", "100000", "100000", "100000", "100000", "100000", "100000", "100000", "2000", "100000", "100000", "100000", "1100", "3000", "100000", "100000", "6000", "100000", "100000", "100000"], {2}: ["T2", "620", "100000", "100000", "100000", "900", "5000", "5000", "1500", "360", "490", "750", "950", "100000", "1400", "10000", "10000", "1150", "100000", "100000", "100000"], {3}: ["T8", "565", "593", "100000", "100000", "555", "560", "590", "580", "430", "450", "550", "550", "430", "450", "590", "590", "540", "590", "700", "700"], {4}: ["T64", "1100", "100000", "100000", "100000", "100000", "100000", "730", "650", "100000", "100000", "650", "650", "100000", "100000", "660", "660", "700", "700", "900", "900"]))

# ----
# Deterioration of Steel
addition = Addition(A=rebar_type, B=stress_type)
addition_2 = Addition(A=addition, B=2)
panel_2 = Panel(data_3)
item = ListItem(List=panel_2, Index=addition, Wrap=True)  # -> flatten(Item)
item_2 = ListItem(List=panel_2, Index=addition_2, Wrap=True)  # -> flatten(Item)
item_3 = ListItem(List=item, Index="0", Wrap=True)  # -> flatten(Item)
item_4 = ListItem(List=item, Index="1", Wrap=True)  # -> flatten(Item)
item_5 = ListItem(List=item, Index="2", Wrap=True)  # -> flatten(Item)
item_6 = ListItem(List=item, Index="3", Wrap=True)  # -> flatten(Item)
item_7 = ListItem(List=item, Index="4", Wrap=True)  # -> flatten(Item)
item_8 = ListItem(List=item_2, Index="0", Wrap=True)  # -> flatten(Item)
item_9 = ListItem(List=item_2, Index="1", Wrap=True)  # -> flatten(Item)
item_10 = ListItem(List=item_2, Index="2", Wrap=True)  # -> flatten(Item)
item_11 = ListItem(List=item_2, Index="3", Wrap=True)  # -> flatten(Item)
item_12 = ListItem(List=item_2, Index="4", Wrap=True)  # -> flatten(Item)

# ---- group: Material Deterioration HOT
material_deterioration = Expression(
    T=data,
    k=item_3,
    T1=item_4,
    T2=item_5,
    T8=item_6,
    T64=item_7,
    Expression="k+((1-k)/(1+(T/T1)+(T/T2)^2+(T/T8)^8+(T/T64)^64))")

# ---- group: Material Deterioration COLD
material_deterioration_2 = Expression(
    T=data,
    k=item_8,
    T1=item_9,
    T2=item_10,
    T8=item_11,
    T64=item_12,
    Expression="k+((1-k)/(1+(T/T1)+(T/T2)^2+(T/T8)^8+(T/T64)^64))")

# ----
xi_t = Data(material_deterioration)
xi_t_2 = Data(material_deterioration_2)
steel_deterioration = ClusterOutput(xi_t)
steel_deterioration_2 = ClusterOutput(xi_t_2)

# ==== cluster DeflectionAnalysisOfBeam: Displays the deflection of the beam based on the duration of the standard fire
initial_beams = ClusterInput()  # List of concrete beam geometry for deflection analyzis
loadsettings = ClusterInput()  # List of load settings
multfactor = ClusterInput()  # Multiplication factor for deflection - 1 = no multiplication
timestep = ClusterInput()  # Time steps of fire development [min] - 0 = No fire impact

# ---- group: LoadSettings
data = Data(loadsettings)

# ----
item = ListItem(List=data, Index=0, Wrap=True)  # -> Item, Item1, Item2

# ---- group: Type
num = Number(item.Item1)

# ---- group: Load
num_2 = Number(item.Item)

# ---- group: Beam
brep = Brep(initial_beams)

# ----
time_step = Number(timestep)

# ---- group: Support
num_3 = Number(item.Item2)

# ---- group: Multiplication Factor
num_4 = Number(multfactor)

# ----
# Initial Beam
brep_2 = Brep(brep)

# ----
# E-modulus variation (TO BE REVISED)
minutes = Panel("0 to 600")
remap = RemapNumbers(Value=time_step, Source=minutes, Target=Domain(0, 1))  # -> Mapped, Clipped
range = Range(Domain=Domain(0, 1), Steps=10)
graph = GraphMapper(
    remap.Mapped,
    x0=0,
    x1=1,
    y0=0,
    y1=1,
    container_name="Bezier",
    cpx=[0, 0.148027271, 0.6342856288, 1],
    cpy=[1, 0.3492753506, 0.2620283365, 0.8647531867])
remap_2 = RemapNumbers(Value=graph, Source="0 to 1", Target="0 to 210")  # -> Mapped, Clipped
e_gpa = Panel(remap_2.Mapped)

debrep = DeconstructBrep(Brep=brep_2)  # -> Faces, Edges, Vertices
srf = Surface(debrep.Faces)
area = Area(Geometry=srf)  # -> Area, Centroid
sort = SortList(Keys=area.Area, ValuesA=area.Centroid)  # -> Keys, ValuesA
sort_2 = SortList(Keys=area.Area, ValuesA=srf)  # -> Keys, ValuesA
item_2 = ListItem(List=sort_2.ValuesA, Index=0, Wrap=True)  # -> Item, Item1

debrep_2 = DeconstructBrep(Brep=item_2.Item)  # -> Faces, Edges, Vertices
len = Length(Curve=debrep_2.Edges)
bnd = Bounds(Numbers=len)
dedomain = DeconstructDomain(Domain=bnd)  # -> Start, End
num_5 = Number(dedomain.Start)
num_6 = Number(dedomain.End)

division = Division(A=num_6, B=1000)
division_2 = Division(A=num_5, B=1000)
expression = Expression(w=division_2, h=division, Expression="1/12*w*h^3")
item_3 = ListItem(List=sort.ValuesA, Index=0, Wrap=True)  # -> Item, Item1
i_m4 = Panel(expression)
ln = Line(StartPoint=item_3.Item1, EndPoint=item_3.Item)

divide = DivideCurve(Curve=ln, Count=Slider(20, range=0..100), Kinks=False)  # -> Points, Tangents, Parameters
crv_cp = CurveClosestPoint(Point=divide.Points, Curve=ln)  # -> Point, Parameter, Distance
shatter = Shatter(Curve=ln, Parameters=crv_cp.Parameter)
len_2 = Length(Curve=shatter)
ma = MassAddition(Input=len_2)  # -> Result, flatten(PartialResults)
ins = InsertItems(List=ma.PartialResults, Item="0", Indices="0", Wrap=True)

len_3 = Length(Curve=ln)
expression_2 = Expression(q=num_2, L=len_3, E=e_gpa, I=i_m4, Expression="(1/8*q*1000*(L/1000)^4/(E*10^9*I))*1000")
# Uniform load
expression_3 = Expression(q=num_2, L=len_3, E=e_gpa, I=i_m4, x=ins, Expression="(1/6*q*1000*(L/1000)^4/(E*10^9*I)*(3/4-x/L+1/4*(x/L)^4))*1000")
# Point load
expression_4 = Expression(q=num_2, L=len_3, E=e_gpa, I=i_m4, x=ins, Expression="(1/2*q*1000*(L/1000)^3/(E*10^9*I)*(2/3-x/L+1/3*(x/L)^3))*1000")
expression_5 = Expression(q=num_2, L=len_3, E=e_gpa, I=i_m4, Expression="(1/3*q*1000*(L/1000)^3/(E*10^9*I))*1000")
# Point load
expression_6 = Expression(q=num_2, L=len_3, E=e_gpa, I=i_m4, Expression="(1/48*q*1000*(L/1000)^3/(E*10^9*I))*1000")
# Uniform load
expression_7 = Expression(q=num_2, L=len_3, E=e_gpa, I=i_m4, Expression="(5/384*q*1000*(L/1000)^4/(E*10^9*I))*1000")
umax_mm = Panel(expression_5)
umax_mm_2 = Panel(expression_2)
u_x_mm = Panel(expression_4)
u_x_mm_2 = Panel(expression_3)
umax_mm_3 = Panel(expression_6)
umax_mm_4 = Panel(expression_7)
num_7 = Number(expression_4)
num_8 = Number(expression_3)
num_9 = Number(expression_6)
num_10 = Number(expression_7)
filter = StreamFilter(Gate=num, Stream0=umax_mm_2, Stream1=umax_mm)
filter_2 = StreamFilter(Gate=num, Stream0=num_8, Stream1=num_7)
filter_3 = StreamFilter(Gate=num, Stream0=num_10, Stream1=num_9)
num_11 = Number(filter_3)
num_12 = Number(filter_2)
multiplication = Multiplication(A=num_11, B=num_4)
multiplication_2 = Multiplication(A=num_12, B=num_4)

eval = EvaluateCurve(Curve=reparameterize(ln), Parameter=Slider(0.5, range=0..1))  # -> Point, Tangent, Angle
Z = UnitZ(Factor=expr("x*-1", multiplication))
move = Move(Geometry=eval.Point, Motion=Z)  # -> flatten(Geometry), Transform

# ----
# Re-create beam on curved line
number_slider = Slider(1, range=0..1)
eval_2 = EvaluateCurve(Curve=reparameterize(ln), Parameter=number_slider)  # -> flatten(Point), Tangent, Angle
eval_3 = EvaluateCurve(Curve=reparameterize(ln), Parameter=Slider(0, range=0..1))  # -> flatten(Point), Tangent, Angle
rev = Reverse(Vector=eval_2.Tangent)
rev_2 = Reverse(Vector=eval_3.Tangent)
pt = Point([eval_2.Point, move.Geometry, eval_3.Point])
intcrv_t = InterpolateT(Vertices=pt, Degree=3, TangentStart=rev, TangentEnd=rev_2, KnotStyle=1)  # -> Curve, Length, Domain
intcrv = Interpolate(Vertices=pt, Degree=3, Periodic=False, KnotStyle=1)  # -> Curve, Length, Domain

# ----
# Simply supported both ends
# Orient end surface
number_slider_2 = Slider(1, range=0..1)
srf_2 = Surface(item_2.Item1)
eval_4 = EvaluateCurve(Curve=reparameterize(intcrv.Curve), Parameter=number_slider_2)  # -> Point, Tangent, Angle
pl = PlaneNormal(Origin=eval_3.Point, ZAxis=rev_2)
pl_2 = PlaneNormal(Origin=eval_4.Point, ZAxis=eval_4.Tangent)
prot = RotatePlane(Plane=pl_2, Angle=degrees(-90))
orient = Orient(Geometry=srf_2, Source=pl, Target=prot)  # -> Geometry, Transform

number_slider_3 = Slider(0.5, range=0..1)
Z_2 = UnitZ(Factor=expr("x*-1", multiplication_2))
move_2 = Move(Geometry=divide.Points, Motion=Z_2)  # -> flatten(Geometry), Transform

# ----
# Re-create beam on curved line
number_slider_4 = Slider(1, range=0..1)
eval_5 = EvaluateCurve(Curve=reparameterize(ln), Parameter=number_slider_4)  # -> flatten(Point), Tangent, Angle
eval_6 = EvaluateCurve(Curve=reparameterize(ln), Parameter=Slider(0, range=0..1))  # -> flatten(Point), Tangent, Angle
rev_3 = Reverse(Vector=eval_5.Tangent)
rev_4 = Reverse(Vector=eval_6.Tangent)
pt_2 = Point([eval_5.Point, move.Geometry, eval_6.Point])
intcrv_2 = Interpolate(Vertices=move_2.Geometry, Degree=3, Periodic=False, KnotStyle=1)  # -> Curve, Length, Domain
intcrv_t_2 = InterpolateT(Vertices=pt_2, Degree=3, TangentStart=rev_3, TangentEnd=rev_4, KnotStyle=1)  # -> Curve, Length, Domain

swp1 = Sweep1(Rail=intcrv.Curve, Sections=orient.Geometry, Miter=1)
cap = CapHoles(Brep=swp1)
brep_3 = Brep(cap)

# ---- group: Deflected Beam
brep_4 = Brep(brep_3)

# ---- group: Umax
num_13 = Number(filter_3)

num_14 = Number(filter)

# ----
filter_4 = StreamFilter(Gate=num_3, Stream0=num_13, Stream1=num_14)

# ---- group: Umax
num_15 = Number(flatten(filter_4))

# ----
deflection = ClusterOutput(num_15)  # Maximum deflection

# ----
# Cantilever
# Orient end surface
number_slider_5 = Slider(0, range=0..1)
srf_3 = Surface(item_2.Item1)
eval_7 = EvaluateCurve(Curve=reparameterize(intcrv_2.Curve), Parameter=number_slider_5)  # -> Point, Tangent, Angle
eval_8 = EvaluateCurve(Curve=reparameterize(ln), Parameter=Slider(0, range=0..1))  # -> Point, Tangent, Angle
pl_3 = PlaneNormal(Origin=eval_5.Point, ZAxis=rev_3)

rev_5 = Reverse(Vector=eval_7.Tangent)
pl_4 = PlaneNormal(Origin=eval_8.Point, ZAxis=eval_8.Tangent)

pl_5 = PlaneNormal(Origin=eval_7.Point, ZAxis=rev_5)
prot_2 = RotatePlane(Plane=pl_5, Angle=degrees(90))
orient_2 = Orient(Geometry=srf_3, Source=pl_4, Target=prot_2)  # -> Geometry, Transform

orient_3 = Orient(Geometry=srf_3, Source=pl_4, Target=pl_3)  # -> Geometry, Transform
geo = Geometry([orient_3.Geometry, orient_2.Geometry])
swp1_2 = Sweep1(Rail=intcrv_2.Curve, Sections=geo, Miter=1)
cap_2 = CapHoles(Brep=swp1_2)
brep_5 = Brep(cap_2)

# ---- group: Deflected Beam
brep_6 = Brep(brep_5)

# ----
filter_5 = StreamFilter(Gate=num_3, Stream0=brep_4, Stream1=brep_6)

# ---- group: Deflected Beam
brep_7 = Brep(flatten(filter_5))

# ----
geometry = ClusterOutput(brep_7)  # Deflected geometry

# ==== cluster TemperatureAnalysis: Calculates the temperature variation through the cross-section at time t of a standard fire - Returns the temperature in given xy-points and the reduction factors for the concrete
sides_exposed = ClusterInput()  # Insert preset value list of different cases of exposure from the "Settings" tab
section_height = ClusterInput()  # Height of section [mm]
temperature_display = ClusterInput()  # Toggle True/False for display of temperature variation through section as a function of the time and concrete properties
concrete_type = ClusterInput()  # Value list of chosen concrete type ( use pre-set value list from the "Settings" tab )
time_step = ClusterInput()  # Time step for temperature calculation of a standard fire [min] ( t = 0, sets the temperature at the edge to 20°C and 0°C in the middle of the section )
section_width = ClusterInput()  # Width of section [mm]
cross_section = ClusterInput()  # Takes a list of curves describing the cross-section ( first item in the list must be the section perimeter )
x_coordinates = ClusterInput()  # List of x-coordinates to evaluate [mm] ( Returns the temperature fore each set of coordinates ) - NB! x goes from left to right
y_coordinates = ClusterInput()  # List of y-coordinates to evaluate [mm] ( Returns the temperature fore each set of coordinates ) - NB! y goes from bot to top

# ---- group: ConType
data = Data(concrete_type)

# ----
number_slider = Slider(15, range=0..100)
python = PythonScript(ConType=data)  # -> rho
# ---------- python: Python ----------
if ConType == 3:
    rho = 1800
elif ConType == 4:
    rho = 1200
elif ConType == 5:
    rho = 600
else:
    rho = 2300
# ---------- end python ----------

# ---- group: x
data_2 = Data(x_coordinates)

# ---- group: y
data_3 = Data(y_coordinates)

# ---- group: Height
data_4 = Data(section_height)

# ----
width = Data(section_width)

# ---- group: Sides
data_5 = Data(sides_exposed)

# ---- group: Time
data_6 = Data(time_step)

# ----
python_2 = PythonScript(Sides=data_5, n=number_slider)  # -> V
# ---------- python_2: Python ----------
if Sides == 0:
    V = 1
elif Sides == 1:
    V = 1
elif Sides == 2:
    V = 1
else:
    V = n
# ---------- end python_2 ----------
tempcalc = TemperatureCalculation(Sides=data_5, t=data_6, W=width, H=data_4, x=data_2, y=data_3, rho=python, n=number_slider)  # -> Txy, TM, Tmm; inputs W: Int32, H: Int32, x: list of Int32, y: list of Int32, n: Int32
# ---------- tempcalc: Python ----------
"""
Temperature Calculation. Calculates temperatures in 1-side to 4-side exposed cross-sections
-----
FireSim made by Thomas Dyhr, DTU.BYG

    Args:
        Sides: Number of sides exposed ( 0 = Bottom side, 1 = 1 side, 2 = 2 parallel sides, 2.5 = 1 side + bottom, 3 = 2 sides + bottom, 4 = all four sides )
        t: Time step for standard fire [min]
        W: Total width of cross-section [mm]
        H: Total height of cross-section [mm]
        x: x-coordinates for temperature calculation [mm]
        y: y-coordinates for temperature calculation [mm]
        rho: Density
        n: Number of lamellas to evaluate for
    Returns:
        Txy: Temperature at distance x [°C]
        TM: Temperature at middle of cross-section [°C]
        Tmm: Temperature for each millimeter of the cross-section [°C]
"""

ghenv.Component.Name = 'Temperature Calculation'
ghenv.Component.NickName = 'TempCalc'
ghenv.Component.Message = 'Temperature Calculation v.008'

#Import classes
from math import log10, exp, pi, sqrt, sin

## Code ##

cp = 1000
Lambda = 0.75

def TempCalc(t,k,x):
    Temp = 312*log10(8*t+1)*exp(-1.9*k*(x/1000))*sin((pi/2)-k*(x/1000))
    return Temp

def TempCalc2X(t,k,x):
    Temp2X = ((TempCalc(t,k,x)+TempCalc(t,k,W-x))*(TempCalc(t,k,0)/(TempCalc(t,k,0)+TempCalc(t,k,W))))
    return Temp2X

def TempCalc2Y(t,k,y):
    Temp2Y = ((TempCalc(t,k,y)+TempCalc(t,k,H-y))*(TempCalc(t,k,0)/(TempCalc(t,k,0)+TempCalc(t,k,H))))
    return Temp2Y

def TempCalc25(t,k,x,y):
    Temp25 = TempCalc(t,k,x)+TempCalc(t,k,y)-((TempCalc(t,k,x)*TempCalc(t,k,y))/TempCalc(t,k,0))
    return Temp25

def TempCalc3(t,k,x,y):
    Temp3 = TempCalc2X(t,k,x)+TempCalc(t,k,y)-((TempCalc2X(t,k,x)*TempCalc(t,k,y))/TempCalc(t,k,0))
    return Temp3

def TempCalc4(t,k,x,y):
    Temp4 = TempCalc2X(t,k,x)+TempCalc2Y(t,k,y)-((TempCalc2X(t,k,x)*TempCalc2Y(t,k,y))/TempCalc(t,k,0))
    return Temp4


if t<1:
    Txy = [20 for i in y]
    TM=20
    Tmm = [20 for i in range(0,n)]
else:
    Txy = []
    Tmm = []
    k = sqrt((pi*rho*cp)/(750*Lambda*t))

# Calculation for Bottom exposure
    if Sides == 0:
        for i in range(len(y)):
            Txy.append(round(TempCalc(t,k,y[i]),2))
        # Temperatue at middle of cross-section
        TM = round(TempCalc(t,k,H/2),2)
        # Temperatue in middle of each lamella
        for i in range(1,n*2,2):
            Y = H/n/2*i
            Temp = round(TempCalc(t,k,Y),2) 
            Tmm.append(Temp)

# Calculation for 1 side exposure
    if Sides == 1:
        for i in range(len(x)):
            Txy.append(round(TempCalc(t,k,x[i]),2))
        # Temperatue at middle of cross-section
        TM = round(TempCalc(t,k,W/2),2)
        # Temperatue in middle of each lamella
        for i in range(1,n*2,2):
            X = W/n/2*i
            Temp = round(TempCalc(t,k,X),2) 
            Tmm.append(Temp)

# Calculation for 2 parallel sides exposed
    elif Sides == 2:
        for i in range(len(x)):
            Txy.append(round( TempCalc2X(t,k,x[i]) ,2))
        # Temperatue at middle of cross-section
        TM = round( TempCalc2X(t,k,W/2) ,2)
        # Temperatue in middle of each lamella
        for i in range(1,n*2,2):
            X = W/n/2*i
            Temp = round( TempCalc2X(t,k,X) ,2) 
            Tmm.append(Temp)

# Calculation for 1 side + bottom exposed
    elif Sides == 2.5:
        for i in range(len(x)):
            Txy.append(round( TempCalc25(t,k,x[i],y[i]) ,2))
        # Temperatue at middle of cross-section
        TM = round( TempCalc25(t,k,W/2,H/2)  ,2)
        # Temperatue in middle of each lamella
        for i in range(1,n*2,2):
            X = W/n/2*i
            for j in range(1,n*2,2):
                Y = H/n/2*j
                Temp = round( TempCalc25(t,k,X,Y) ,2)
                Tmm.append(Temp)

# Calculation for 3 sides exposed
    elif Sides == 3:
        for i in range(len(x)):
            Txy.append(round( TempCalc3(t,k,x[i],y[i]) ,2))
        # Temperatue at middle of cross-section
        TM = round( TempCalc3(t,k,W/2,H/2)  ,2)
        # Temperatue in middle of each lamella
        for i in range(1,n*2,2):
            X = W/n/2*i
            for j in range(1,n*2,2):
                Y = H/n/2*j
                Temp = round( TempCalc3(t,k,X,Y) ,2)
                Tmm.append(Temp)

# Calculation for 4 sides exposed
    elif Sides == 4:
        for i in range(len(x)):
            Txy.append(round( TempCalc4(t,k,x[i],y[i]) ,2))
        # Temperatue at middle of cross-section
        TM = round( TempCalc4(t,k,W/2,H/2)  ,2)
        # Temperatue in middle of each lamella
        for i in range(1,n*2,2):
            X = W/n/2*i
            for j in range(1,n*2,2):
                Y = H/n/2*j
                Temp = round( TempCalc4(t,k,X,Y) ,2)
                Tmm.append(Temp)

# Replacing all temperatures below 20°C with 20°C
Txy[:] = [20 if i<20 else i for i in Txy]
if TM < 20:
    TM = 20
Tmm[:] = [20 if i<20 else i for i in Tmm]
# ---------- end tempcalc ----------

# ---- group: Section
data_7 = Data(cross_section)

# ----
data_8 = Data([number_slider, python_2])
python_3 = PythonScript(Sides=data_5)  # -> a
# ---------- python_3: Python ----------
if Sides == 0:
    a = 0
else:
    a = 1
# ---------- end python_3 ----------
rev = ReverseList(List=data_8)
item = ListItem(List=data_7, Index=0, Wrap=True)
temperature_at_xy = Panel(tempcalc.Txy)
temperature_at_mid = Panel(tempcalc.TM)
filter = StreamFilter(Gate=python_3, Stream0=rev, Stream1=data_8)
temperature_for_each_lamella = Panel(tempcalc.Tmm)
item_2 = ListItem(List=filter, Index=0, Wrap=True)  # -> Item, Item1
dom² = ConstructDomain²(DomainU=width, DomainV=data_4)
divide = DivideDomain²(Domain=dom², UCount=item_2.Item, VCount=item_2.Item1)
subsrf = Isotrim(Surface=item, Domain=divide)

# ----
# Concrete Deterioration for each mm
concdeter = DeteriorationOfConcrete(concrete_type=data, temperature=temperature_for_each_lamella)  # -> hot_condition, cold_condition

# ----
# Concrete Deterioration Mid Point
concdeter_2 = DeteriorationOfConcrete(concrete_type=data, temperature=tempcalc.TM)  # -> flatten(hot_condition), flatten(cold_condition)

mplane = MeshPlane(Boundary=subsrf, WidthCount="1", HeightCount="1")  # -> Mesh, Area
lng = ListLength(List=concdeter.hot_condition)
lng_2 = ListLength(List=concdeter.cold_condition)
ma = MassAddition(Input=concdeter.hot_condition)  # -> Result, PartialResults
ma_2 = MassAddition(Input=concdeter.cold_condition)  # -> Result, PartialResults
dom = ConstructDomain(DomainStart=Slider(20, range=0..100), DomainEnd=Slider(1200, range=0..10000))
remap = RemapNumbers(Value=temperature_for_each_lamella, Source=dom, Target=Domain(0, 1))  # -> Mapped, Clipped
division = Division(A=ma_2.Result, B=lng_2)
division_2 = Division(A=ma.Result, B=lng)
python_4 = PythonScript(x=remap.Mapped)  # -> a
# ---------- python_4: Python ----------
if not x:
    a = 0
else:
    a = x
# ---------- end python_4 ----------

# ---- group: Display
data_9 = Data(temperature_display)

# ----
avg_reduction = Panel(division)
avg_reduction_2 = Panel(division_2)

xicmhot = Panel(concdeter_2.hot_condition)
xicmcold = Panel(concdeter_2.cold_condition)

gradient = Gradient(
    LowerLimit="1",
    UpperLimit="0",
    Parameter=python_4,
    stops=[0: RGB(255, 0, 0), 0.335: RGB(234, 126, 0), 0.664: RGB(254, 244, 84), 1: RGB(173, 203, 249)])
filter_2 = StreamFilter(Gate=data_9, Stream1=mplane.Mesh)
division_3 = Division(A=avg_reduction, B=xicmcold)  # -> flatten(Result)
division_4 = Division(A=avg_reduction_2, B=xicmhot)  # -> flatten(Result)

n_hot = Panel(division_4)
n_cold = Panel(division_3)

mcol = MeshColours(Mesh=graft(filter_2), Colours=graft(gradient))
mjoin = MeshJoin(Meshes=flatten(mcol))
data_10 = Data(avg_reduction)
data_11 = Data(n_cold)
data_12 = Data(flatten(tempcalc.Txy))
data_13 = Data(avg_reduction_2)
data_14 = Data(n_hot)
data_15 = Data(xicmcold)
data_16 = Data(xicmhot)
weld = WeldMesh(Mesh=mjoin, Angle=3.141592654)
average_deterioration_cold = ClusterOutput(data_10)  # The avarage reduction factor of concrete strength in COLD condition as a function of the temperature
average_deterioration_hot = ClusterOutput(data_13)  # The avarage reduction factor of concrete strength in HOT condition as a function of the temperature
deterioration_at_midpoint = ClusterOutput(data_16)  # The reduction factor in the middle of the section in HOT condition as a function of the temperature
deterioration_at_midpoint_2 = ClusterOutput(data_15)  # The reduction factor in the middle of the section in COLD condition as a function of the temperature
stress_distribution_factor = ClusterOutput(data_14)  # Stress Distribution Factor in HOT condition
temperature_at_x_y = ClusterOutput(data_12)  # Calculated temperatures at x,y [°C]
stress_distribution_factor_2 = ClusterOutput(data_11)  # Stress Distribution Factor in COLD condition
coloured_mesh = ClusterOutput(weld)

bnd = Bounds(Numbers=temperature_for_each_lamella)
dedomain = DeconstructDomain(Domain=bnd)  # -> Start, End
python_5 = PythonScript(x=dedomain.End)  # -> a
# ---------- python_5: Python ----------
if x == 20:
    a = 0
else:
    a = 1
# ---------- end python_5 ----------
dom_2 = ConstructDomain(DomainStart="20", DomainEnd=dedomain.End)

dom_3 = ConstructDomain(DomainStart="20", DomainEnd="0")

filter_3 = StreamFilter(Gate=python_5, Stream0=dom_3, Stream1=dom_2)

# ==== cluster DeflectionAnalysisOfBeam_2: Displays the deflection of the beam based on the duration of the standard fire
initial_beams = ClusterInput()  # List of concrete beam geometry for deflection analyzis
concrete_strength = ClusterInput()  # Concrete strength at 20°C for E-modulus calculation [MPa]
loadsettings = ClusterInput()  # List of load settings
area_of_steel = ClusterInput()  # Total area of steel in the cross-section [mm2]
multfactor = ClusterInput()  # Multiplication factor for deflection - 1 = no multiplication
average_concrete_deterioration = ClusterInput()  # Average Concrete Deterioration in either HOT or COLD condition
average_steel_deterioration = ClusterInput()  # Average steel reduction for all rebars in the cross-section
e_modulus_steel = ClusterInput()  # E-modulus of steel [GPa]

# ---- group: LoadSettings
data = Data(loadsettings)

# ----
item = ListItem(List=data, Index=0, Wrap=True)  # -> Item, Item1, Item2

# ---- group: Type
num = Number(item.Item1)

# ---- group: steelAvg
data_2 = Data(average_steel_deterioration)

# ---- group: Load
num_2 = Number(item.Item)

# ---- group: Beam
brep = Brep(initial_beams)

# ---- group: As
data_3 = Data(area_of_steel)

# ---- group: conAvg
data_4 = Data(average_concrete_deterioration)

# ---- group: fcc
data_5 = Data(concrete_strength)

# ---- group: Support
num_3 = Number(item.Item2)

# ---- group: Es
data_6 = Data(e_modulus_steel)

# ---- group: Multiplication Factor
num_4 = Number(multfactor)

# ----
expression = Expression(fcc=data_5, Expression="20*(fcc/10)^0.3")

# ----
# Initial Beam
brep_2 = Brep(brep)

multiplication = Multiplication(A=data_3, B=data_6)
debrep = DeconstructBrep(Brep=brep_2)  # -> Faces, Edges, Vertices

# ----
# E-modulus variation (TO BE REVISED)
minutes = Panel("0 to 600")
remap = RemapNumbers(Source=minutes, Target=Domain(0, 1))  # -> Mapped, Clipped
range = Range(Domain=Domain(0, 1), Steps=10)
graph = GraphMapper(
    remap.Mapped,
    x0=0,
    x1=1,
    y0=0,
    y1=1,
    container_name="Bezier",
    cpx=[0, 0.148027271, 0.6342856288, 1],
    cpy=[1, 0.3492753506, 0.2620283365, 0.6620869637])
remap_2 = RemapNumbers(Value=graph, Source="0 to 1", Target="0 to 210")  # -> Mapped, Clipped
e_gpa = Panel(remap_2.Mapped)

multiplication_2 = Multiplication(A=multiplication, B=data_2)
srf = Surface(debrep.Faces)
area = Area(Geometry=srf)  # -> Area, Centroid

# ---- group: As*Es*ξsAvg
data_7 = Data(multiplication_2)

# ----
sort = SortList(Keys=area.Area, ValuesA=area.Centroid)  # -> Keys, ValuesA
sort_2 = SortList(Keys=area.Area, ValuesA=srf)  # -> Keys, ValuesA
item_2 = ListItem(List=sort.Keys, Index=0, Wrap=True)

# ---- group: Total area of section
data_8 = Data(item_2)

# ----
subtraction = Subtraction(A=data_8, B=data_3)

# ---- group: Ac
data_9 = Data(subtraction)

# ----
multiplication_3 = Multiplication(A=expression, B=data_9)
multiplication_4 = Multiplication(A=multiplication_3, B=data_4)

# ---- group: Ac*Ec*ξcAvg
data_10 = Data(multiplication_4)

# ----
addition = Addition(A=data_10, B=data_7)
item_3 = ListItem(List=sort_2.ValuesA, Index=0, Wrap=True)  # -> Item, Item1

debrep_2 = DeconstructBrep(Brep=item_3.Item)  # -> Faces, Edges, Vertices
len = Length(Curve=debrep_2.Edges)
bnd = Bounds(Numbers=len)
dedomain = DeconstructDomain(Domain=bnd)  # -> Start, End
num_5 = Number(dedomain.Start)
num_6 = Number(dedomain.End)

division = Division(A=num_6, B=1000)
division_2 = Division(A=num_5, B=1000)
expression_2 = Expression(w=division_2, h=division, Expression="1/12*w*h^3")
item_4 = ListItem(List=sort.ValuesA, Index=0, Wrap=True)  # -> Item, Item1
division_3 = Division(A=addition, B=data_8)
i_m4 = Panel(expression_2)
ln = Line(StartPoint=item_4.Item1, EndPoint=item_4.Item)

divide = DivideCurve(Curve=ln, Count=Slider(20, range=0..100), Kinks=False)  # -> Points, Tangents, Parameters
crv_cp = CurveClosestPoint(Point=divide.Points, Curve=ln)  # -> Point, Parameter, Distance
shatter = Shatter(Curve=ln, Parameters=crv_cp.Parameter)
len_2 = Length(Curve=shatter)
ma = MassAddition(Input=len_2)  # -> Result, flatten(PartialResults)
ins = InsertItems(List=ma.PartialResults, Item="0", Indices="0", Wrap=True)

# ---- group: E-combined
data_11 = Data(division_3)

# ----
len_3 = Length(Curve=ln)
expression_3 = Expression(q=num_2, L=len_3, E=data_11, I=i_m4, Expression="(1/8*q*1000*(L/1000)^4/(E*10^9*I))*1000")
# Uniform load
expression_4 = Expression(q=num_2, L=len_3, E=data_11, I=i_m4, x=ins, Expression="(1/6*q*1000*(L/1000)^4/(E*10^9*I)*(3/4-x/L+1/4*(x/L)^4))*1000")
# Point load
expression_5 = Expression(q=num_2, L=len_3, E=data_11, I=i_m4, x=ins, Expression="(1/2*q*1000*(L/1000)^3/(E*10^9*I)*(2/3-x/L+1/3*(x/L)^3))*1000")
expression_6 = Expression(q=num_2, L=len_3, E=data_11, I=i_m4, Expression="(1/3*q*1000*(L/1000)^3/(E*10^9*I))*1000")
# Point load
expression_7 = Expression(q=num_2, L=len_3, E=data_11, I=i_m4, Expression="(1/48*q*1000*(L/1000)^3/(E*10^9*I))*1000")
# Uniform load
expression_8 = Expression(q=num_2, L=len_3, E=data_11, I=i_m4, Expression="(5/384*q*1000*(L/1000)^4/(E*10^9*I))*1000")
umax_mm = Panel(expression_6)
umax_mm_2 = Panel(expression_3)
u_x_mm = Panel(expression_5)
u_x_mm_2 = Panel(expression_4)
umax_mm_3 = Panel(expression_7)
umax_mm_4 = Panel(expression_8)
num_7 = Number(expression_5)
num_8 = Number(expression_4)
num_9 = Number(expression_7)
num_10 = Number(expression_8)
filter = StreamFilter(Gate=num, Stream0=umax_mm_2, Stream1=umax_mm)
filter_2 = StreamFilter(Gate=num, Stream0=num_8, Stream1=num_7)
filter_3 = StreamFilter(Gate=num, Stream0=num_10, Stream1=num_9)
num_11 = Number(filter_3)
num_12 = Number(filter_2)
multiplication_5 = Multiplication(A=num_11, B=num_4)
multiplication_6 = Multiplication(A=num_12, B=num_4)

eval = EvaluateCurve(Curve=reparameterize(ln), Parameter=Slider(0.5, range=0..1))  # -> Point, Tangent, Angle
Z = UnitZ(Factor=expr("x*-1", multiplication_5))
move = Move(Geometry=eval.Point, Motion=Z)  # -> flatten(Geometry), Transform

# ----
# Re-create beam on curved line
number_slider = Slider(1, range=0..1)
eval_2 = EvaluateCurve(Curve=reparameterize(ln), Parameter=number_slider)  # -> flatten(Point), Tangent, Angle
eval_3 = EvaluateCurve(Curve=reparameterize(ln), Parameter=Slider(0, range=0..1))  # -> flatten(Point), Tangent, Angle
rev = Reverse(Vector=eval_2.Tangent)
rev_2 = Reverse(Vector=eval_3.Tangent)
pt = Point([eval_2.Point, move.Geometry, eval_3.Point])
intcrv_t = InterpolateT(Vertices=pt, Degree=3, TangentStart=rev, TangentEnd=rev_2, KnotStyle=1)  # -> Curve, Length, Domain
intcrv = Interpolate(Vertices=pt, Degree=3, Periodic=False, KnotStyle=1)  # -> Curve, Length, Domain

# ----
# Simply supported both ends
# Orient end surface
number_slider_2 = Slider(1, range=0..1)
srf_2 = Surface(item_3.Item1)
eval_4 = EvaluateCurve(Curve=reparameterize(intcrv.Curve), Parameter=number_slider_2)  # -> Point, Tangent, Angle
pl = PlaneNormal(Origin=eval_3.Point, ZAxis=rev_2)
pl_2 = PlaneNormal(Origin=eval_4.Point, ZAxis=eval_4.Tangent)
prot = RotatePlane(Plane=pl_2, Angle=degrees(-90))
orient = Orient(Geometry=srf_2, Source=pl, Target=prot)  # -> Geometry, Transform

number_slider_3 = Slider(0.5, range=0..1)
Z_2 = UnitZ(Factor=expr("x*-1", multiplication_6))
move_2 = Move(Geometry=divide.Points, Motion=Z_2)  # -> flatten(Geometry), Transform

# ----
# Re-create beam on curved line
number_slider_4 = Slider(1, range=0..1)
eval_5 = EvaluateCurve(Curve=reparameterize(ln), Parameter=number_slider_4)  # -> flatten(Point), Tangent, Angle
eval_6 = EvaluateCurve(Curve=reparameterize(ln), Parameter=Slider(0, range=0..1))  # -> flatten(Point), Tangent, Angle
rev_3 = Reverse(Vector=eval_5.Tangent)
rev_4 = Reverse(Vector=eval_6.Tangent)
pt_2 = Point([eval_5.Point, move.Geometry, eval_6.Point])
intcrv_2 = Interpolate(Vertices=move_2.Geometry, Degree=3, Periodic=False, KnotStyle=1)  # -> Curve, Length, Domain
intcrv_t_2 = InterpolateT(Vertices=pt_2, Degree=3, TangentStart=rev_3, TangentEnd=rev_4, KnotStyle=1)  # -> Curve, Length, Domain

swp1 = Sweep1(Rail=intcrv.Curve, Sections=orient.Geometry, Miter=1)
cap = CapHoles(Brep=swp1)
brep_3 = Brep(cap)

# ---- group: Deflected Beam
brep_4 = Brep(brep_3)

# ---- group: Umax
num_13 = Number(filter_3)

num_14 = Number(filter)

# ----
filter_4 = StreamFilter(Gate=num_3, Stream0=num_13, Stream1=num_14)

# ---- group: Umax
num_15 = Number(flatten(filter_4))

# ----
deflection = ClusterOutput(num_15)  # Maximum deflection [mm]

# ----
# Cantilever
# Orient end surface
number_slider_5 = Slider(0, range=0..1)
srf_3 = Surface(item_3.Item1)
eval_7 = EvaluateCurve(Curve=reparameterize(intcrv_2.Curve), Parameter=number_slider_5)  # -> Point, Tangent, Angle
eval_8 = EvaluateCurve(Curve=reparameterize(ln), Parameter=Slider(0, range=0..1))  # -> Point, Tangent, Angle
pl_3 = PlaneNormal(Origin=eval_5.Point, ZAxis=rev_3)

rev_5 = Reverse(Vector=eval_7.Tangent)
pl_4 = PlaneNormal(Origin=eval_8.Point, ZAxis=eval_8.Tangent)

pl_5 = PlaneNormal(Origin=eval_7.Point, ZAxis=rev_5)
prot_2 = RotatePlane(Plane=pl_5, Angle=degrees(90))
orient_2 = Orient(Geometry=srf_3, Source=pl_4, Target=prot_2)  # -> Geometry, Transform

orient_3 = Orient(Geometry=srf_3, Source=pl_4, Target=pl_3)  # -> Geometry, Transform
geo = Geometry([orient_3.Geometry, orient_2.Geometry])
swp1_2 = Sweep1(Rail=intcrv_2.Curve, Sections=geo, Miter=1)
cap_2 = CapHoles(Brep=swp1_2)
brep_5 = Brep(cap_2)

# ---- group: Deflected Beam
brep_6 = Brep(brep_5)

# ----
filter_5 = StreamFilter(Gate=num_3, Stream0=brep_4, Stream1=brep_6)

# ---- group: Deflected Beam
brep_7 = Brep(flatten(filter_5))

# ----
geometry = ClusterOutput(brep_7)  # Deflected geometry

# ==== cluster DeteriorationOfConcrete
concrete_type = ClusterInput()
temperature = ClusterInput()
panel = Panel("C:\Users\Thomas Dyhr\Dropbox\Algoritmic modelling - Grasshopper\Deterioration Constants for Concrete.xlsx")
excelread = ExcelReader(ReadExcelData=Toggle(False), WorkbookPath=panel, WorksheetName="Sheet1")  # -> Exceptions, ExcelData
data = Data(excelread.ExcelData)
python = PythonScript(ConType=concrete_type)  # -> out, a
# ---------- python: Python ----------
if ConType==2:
    a=[0,3,4,5,6]
elif ConType==1:
    a=[0,1,2,5,6]
else:
    a=[0,1,2,3,4]
# ---------- end python ----------
data_2 = Data(Tree({0}: ["k", "0", "0", "0", "0", "0", "0"], {1}: ["T1", "15000", "3500", "100000", "10000", "100000", "4000"], {2}: ["T2", "800", "600", "1080", "780", "1100", "650"], {3}: ["T8", "570", "480", "690", "490", "800", "830"], {4}: ["T64", "100000", "680", "1000", "100000", "940", "930"]))
data_3 = Data(temperature)
panel_2 = Panel(data_2)
cull_i = CullIndex(List=panel_2, Indices=python.a, Wrap=True)
item = ListItem(List=cull_i, Index=1, Wrap=True)  # -> flatten(Item)
panel_3 = Panel(item)
item_2 = ListItem(List=cull_i, Index=0, Wrap=True)  # -> flatten(Item)
item_3 = ListItem(List=item_2, Index="0", Wrap=True)  # -> flatten(Item)
item_4 = ListItem(List=item_2, Index="1", Wrap=True)  # -> flatten(Item)
item_5 = ListItem(List=item, Index="0", Wrap=True)  # -> flatten(Item)
item_6 = ListItem(List=item, Index="1", Wrap=True)  # -> flatten(Item)
item_7 = ListItem(List=item_2, Index="2", Wrap=True)  # -> flatten(Item)
item_8 = ListItem(List=item_2, Index="3", Wrap=True)  # -> flatten(Item)
item_9 = ListItem(List=item_2, Index="4", Wrap=True)  # -> flatten(Item)
item_10 = ListItem(List=item, Index="2", Wrap=True)  # -> flatten(Item)
item_11 = ListItem(List=item, Index="3", Wrap=True)  # -> flatten(Item)
item_12 = ListItem(List=item, Index="4", Wrap=True)  # -> flatten(Item)
material_deterioration = Expression(
    T=data_3,
    k=item_3,
    T1=item_4,
    T2=item_7,
    T8=item_8,
    T64=item_9,
    Expression="k+((1-k)/(1+(T/T1)+(T/T2)^2+(T/T8)^8+(T/T64)^64))")
material_deterioration_2 = Expression(
    T=data_3,
    k=item_5,
    T1=item_6,
    T2=item_10,
    T8=item_11,
    T64=item_12,
    Expression="k+((1-k)/(1+(T/T1)+(T/T2)^2+(T/T8)^8+(T/T64)^64))")
xi_t = Data(material_deterioration)
xi_t_2 = Data(material_deterioration_2)
hot_condition = ClusterOutput(xi_t)
cold_condition = ClusterOutput(xi_t_2)
