# Grasshopper definition Cross-Sections.gh (Grasshopper 0.9.76)

panel = Panel("""FireSim
"Cross-sections"

Thomas Dyhr

29-09-2017""")

# ---- group: Beams
brep = Brep([<brep referenced from the Rhino model> x3])

# ---- group: Rebars
brep_2 = Brep([<brep referenced from the Rhino model> x9])

# ----
cluster = Cluster(beam_geometries=brep, reinforcment_bars=brep_2)  # -> length, width_2, height_2, coordinates, areas, depth_of_rebars

panel_2 = Panel(cluster.areas)
panel_3 = Panel(cluster.width_2)
panel_4 = Panel(cluster.height_2)
panel_5 = Panel(cluster.length)
panel_6 = Panel(cluster.depth_of_rebars)
panel_7 = Panel(cluster.coordinates)

reinforcment_bars = ReinforcmentBars()  # Pick all reinforcement bars (The component will for each beam test which reinforcement bars that are related to that beam)
beam_geometries = BeamGeometries()  # Pick all beams (Closed polysurfaces)

# ---- group: Rebars
brep_3 = Brep(reinforcment_bars)

# ---- group: Beams
brep_4 = Brep(beam_geometries)

# ----
volume = Volume(Geometry=flatten(brep_3))  # -> Volume, Centroid
brep_5 = Brep(graft(brep_4))
brepsinc = PointInBreps(Brep=brep_5, Point=volume.Centroid, Strict=False)  # -> Inside, Index
cull = CullPattern(List=brep_3, CullPattern=brepsinc.Inside)
brep_6 = Brep(brep_5)
brep_7 = Brep(cull)
debrep = DeconstructBrep(Brep=brep_6)  # -> Faces, Edges, Vertices
area = Area(Geometry=debrep.Faces)  # -> Area, Centroid
sort = SortList(Keys=area.Area, ValuesA=debrep.Faces)  # -> Keys, ValuesA
item = ListItem(List=sort.ValuesA, Index=0, Wrap=True)  # -> Item, Item1
volume_2 = Volume(Geometry=brep_6)  # -> Volume, Centroid
area_2 = Area(Geometry=item.Item1)  # -> Area, Centroid
area_3 = Area(Geometry=item.Item)  # -> Area, Centroid
pl_origin = PlaneOrigin(Base=item.Item, Origin=volume_2.Centroid)
sec = BrepPlane(Brep=brep_7, Plane=pl_origin)  # -> flatten(Curves), Points

# ---- group: Rebar sections
crv = Curve(sec.Curves)

# ----
dist = Distance(PointA=area_3.Centroid, PointB=area_2.Centroid)
darc = DeconstructArc(Arc=crv)  # -> BasePlane, Radius, Angle
sec_2 = BrepPlane(Brep=brep_6, Plane=pl_origin)  # -> Curves, Points

# ---- group: Beam Length
num = Number(simplify(dist))

# ----
brepsinc_2 = PointInBreps(Brep=brep_5, Point=darc.BasePlane, Strict=False)  # -> Inside, Index
explode = Explode(Curve=sec_2.Curves, Recursive=True)  # -> Segments, Vertices

# ---- group: Cross section
cross = Curve(sec_2.Curves)

# ----
cullpt = CullDuplicates(Points=explode.Vertices, Tolerance=0.1, CullMode=3)  # -> Points, Indices, Valence
cull_2 = CullPattern(List=darc.BasePlane, CullPattern=brepsinc_2.Inside)
cull_3 = CullPattern(List=darc.Radius, CullPattern=brepsinc_2.Inside)
len = Length(Curve=explode.Segments)
pdecon = Deconstruct(Point=cullpt.Points)  # -> XComponent, YComponent, ZComponent
bnd = Bounds(Numbers=len)
bnd_2 = Bounds(Numbers=pdecon.ZComponent)
expression = Expression(x=cull_3, Expression="x^2*π")
dedomain = DeconstructDomain(Domain=bnd)  # -> Start, End
dedomain_2 = DeconstructDomain(Domain=bnd_2)  # -> Start, End
height = Number(simplify(dedomain.End))
# Geometry analysis
width = Number(simplify(dedomain.Start))
round = Round(Number=expression)  # -> Nearest, Floor, Ceiling
mindex = MemberIndex(Set=pdecon.ZComponent, Member=dedomain_2.Start)  # -> Index, Count

# ---- group: Area of each rebar
num_2 = Number(simplify(round.Floor))

# ----
item_2 = ListItem(List=cullpt.Points, Index=mindex.Index, Wrap=True)
item_3 = ListItem(List=item_2, Index=0, Wrap=True)
panel_8 = Panel(num_2)

# ---- group: Base point for plane
pt = Point(simplify(item_3))

# ----
mindex_2 = MemberIndex(Set=cullpt.Points, Member=pt)  # -> Index, Count
pt_2 = Point(cull_2)
cull_i = CullIndex(List=cullpt.Points, Indices=mindex_2.Index, Wrap=True)
lng = ListLength(List=pt_2)
cp = ClosestPoint(Point=pt, Cloud=cull_i)  # -> ClosestPoint, CPIndex, Distance
mindex_3 = MemberIndex(Set=cull_i, Member=cp.ClosestPoint)  # -> Index, Count
division = Division(A=lng, B=2)
cull_i_2 = CullIndex(List=cull_i, Indices=mindex_3.Index, Wrap=True)
round_2 = Round(Number=division)  # -> Nearest, Floor, Ceiling
cp_2 = ClosestPoint(Point=pt, Cloud=cull_i_2)  # -> ClosestPoint, CPIndex, Distance
cps = ClosestPoints(Point=pt, Cloud=pt_2, Count=round_2.Ceiling)  # -> ClosestPoint, CPIndex, Distance

# ---- group: X-axis
vec2pt = Vector2Pt(PointA=pt, PointB=cp.ClosestPoint, Unitize=False)  # -> Vector, Length

# ---- group: Y-axis
vec2pt_2 = Vector2Pt(PointA=pt, PointB=cp_2.ClosestPoint, Unitize=False)  # -> Vector, Length

# ---- group: Center points for rebars
pt_3 = Point(cps.ClosestPoint)

# ----
vdis = VectorDisplay(Anchor=pt, Vector=vec2pt.Vector)
vdis_2 = VectorDisplay(Anchor=pt, Vector=vec2pt_2.Vector)
pl = ConstructPlane(Origin=pt, XAxis=vec2pt.Vector, YAxis=vec2pt_2.Vector)
cp_3 = PlaneClosestPoint(Point=pt_3, Plane=pl)  # -> Point, UVPoint, Distance

pdecon_2 = Deconstruct(Point=cp_3.UVPoint)  # -> XComponent, flatten(YComponent), ZComponent
item_4 = ListItem(List=pdecon_2.YComponent, Index=0, Wrap=True)
subtraction = Subtraction(A=height, B=item_4)  # -> flatten(Result)
ds = Number(subtraction)

# ---- group: Pt (Coordinates) for temp. calculation
pt_4 = Point(simplify(cp_3.UVPoint))

# ----
areas = Areas(num_2)  # Returns the rebar areas for each beam
coordinates = Coordinates(pt_4)  # Returns the local xy- coordinates of half of the rebars in each beam cross-section (Due to symmetry)
depth_of_rebars = DepthOfRebars(ds)  # Returns the reinforcement layer depth from the compressed edge of the beam
length = Length(num)  # Returns the length of each beam
width_2 = Width(width)  # Returns the width of each beam
height_2 = Height(height)  # Returns the height of each beam

# ==== cluster Cluster
reinforcment_bars = ClusterInput()  # Pick all reinforcement bars (The component will for each beam test which reinforcement bars that are related to that beam)
beam_geometries = ClusterInput()  # Pick all beams (Closed polysurfaces)
brep = Brep(reinforcment_bars)
brep_2 = Brep(beam_geometries)
volume = Volume(Geometry=flatten(brep))  # -> Volume, Centroid
brep_3 = Brep(graft(brep_2))
brepsinc = PointInBreps(Brep=brep_3, Point=volume.Centroid, Strict=False)  # -> Inside, Index
cull = CullPattern(List=brep, CullPattern=brepsinc.Inside)
brep_4 = Brep(brep_3)
brep_5 = Brep(cull)
debrep = DeconstructBrep(Brep=brep_4)  # -> Faces, Edges, Vertices
area = Area(Geometry=debrep.Faces)  # -> Area, Centroid
sort = SortList(Keys=area.Area, ValuesA=debrep.Faces)  # -> Keys, ValuesA
item = ListItem(List=sort.ValuesA, Index=0, Wrap=True)  # -> Item, Item1
volume_2 = Volume(Geometry=brep_4)  # -> Volume, Centroid
area_2 = Area(Geometry=item.Item1)  # -> Area, Centroid
area_3 = Area(Geometry=item.Item)  # -> Area, Centroid
pl_origin = PlaneOrigin(Base=item.Item, Origin=volume_2.Centroid)
sec = BrepPlane(Brep=brep_5, Plane=pl_origin)  # -> flatten(Curves), Points
crv = Curve(sec.Curves)
dist = Distance(PointA=area_3.Centroid, PointB=area_2.Centroid)
darc = DeconstructArc(Arc=crv)  # -> BasePlane, Radius, Angle
sec_2 = BrepPlane(Brep=brep_4, Plane=pl_origin)  # -> Curves, Points
num = Number(simplify(dist))
brepsinc_2 = PointInBreps(Brep=brep_3, Point=darc.BasePlane, Strict=False)  # -> Inside, Index
explode = Explode(Curve=sec_2.Curves, Recursive=True)  # -> Segments, Vertices
cross = Curve(sec_2.Curves)
cullpt = CullDuplicates(Points=explode.Vertices, Tolerance=0.1, CullMode=3)  # -> Points, Indices, Valence
cull_2 = CullPattern(List=darc.BasePlane, CullPattern=brepsinc_2.Inside)
cull_3 = CullPattern(List=darc.Radius, CullPattern=brepsinc_2.Inside)
len = Length(Curve=explode.Segments)
pdecon = Deconstruct(Point=cullpt.Points)  # -> XComponent, YComponent, ZComponent
bnd = Bounds(Numbers=len)
bnd_2 = Bounds(Numbers=pdecon.ZComponent)
expression = Expression(x=cull_3, Expression="x^2*π")
dedomain = DeconstructDomain(Domain=bnd)  # -> Start, End
dedomain_2 = DeconstructDomain(Domain=bnd_2)  # -> Start, End
height = Number(simplify(dedomain.End))
# Geometry analysis
width = Number(simplify(dedomain.Start))
round = Round(Number=expression)  # -> Nearest, Floor, Ceiling
mindex = MemberIndex(Set=pdecon.ZComponent, Member=dedomain_2.Start)  # -> Index, Count
num_2 = Number(simplify(round.Floor))
item_2 = ListItem(List=cullpt.Points, Index=mindex.Index, Wrap=True)
item_3 = ListItem(List=item_2, Index=0, Wrap=True)
panel = Panel(num_2)
pt = Point(simplify(item_3))
mindex_2 = MemberIndex(Set=cullpt.Points, Member=pt)  # -> Index, Count
pt_2 = Point(cull_2)
cull_i = CullIndex(List=cullpt.Points, Indices=mindex_2.Index, Wrap=True)
lng = ListLength(List=pt_2)
cp = ClosestPoint(Point=pt, Cloud=cull_i)  # -> ClosestPoint, CPIndex, Distance
mindex_3 = MemberIndex(Set=cull_i, Member=cp.ClosestPoint)  # -> Index, Count
division = Division(A=lng, B=2)
cull_i_2 = CullIndex(List=cull_i, Indices=mindex_3.Index, Wrap=True)
round_2 = Round(Number=division)  # -> Nearest, Floor, Ceiling
cp_2 = ClosestPoint(Point=pt, Cloud=cull_i_2)  # -> ClosestPoint, CPIndex, Distance
cps = ClosestPoints(Point=pt, Cloud=pt_2, Count=round_2.Ceiling)  # -> ClosestPoint, CPIndex, Distance
vec2pt = Vector2Pt(PointA=pt, PointB=cp.ClosestPoint, Unitize=False)  # -> Vector, Length
vec2pt_2 = Vector2Pt(PointA=pt, PointB=cp_2.ClosestPoint, Unitize=False)  # -> Vector, Length
pt_3 = Point(cps.ClosestPoint)
vdis = VectorDisplay(Anchor=pt, Vector=vec2pt.Vector)
vdis_2 = VectorDisplay(Anchor=pt, Vector=vec2pt_2.Vector)
pl = ConstructPlane(Origin=pt, XAxis=vec2pt.Vector, YAxis=vec2pt_2.Vector)
cp_3 = PlaneClosestPoint(Point=pt_3, Plane=pl)  # -> Point, UVPoint, Distance
pdecon_2 = Deconstruct(Point=cp_3.UVPoint)  # -> XComponent, flatten(YComponent), ZComponent
pt_4 = Point(simplify(cp_3.UVPoint))
item_4 = ListItem(List=pdecon_2.YComponent, Index=0, Wrap=True)
subtraction = Subtraction(A=height, B=item_4)  # -> flatten(Result)
ds = Number(subtraction)
areas = ClusterOutput(num_2)  # Returns the rebar areas for each beam
coordinates = ClusterOutput(pt_4)  # Returns the local xy- coordinates of half of the rebars in each beam cross-section (Due to symmetry)
depth_of_rebars = ClusterOutput(ds)  # Returns the reinforcement layer depth from the compressed edge of the beam
length = ClusterOutput(num)  # Returns the length of each beam
width_2 = ClusterOutput(width)  # Returns the width of each beam
height_2 = ClusterOutput(height)  # Returns the height of each beam
