# Grasshopper definition DeteriorationConstants.gh (Grasshopper 0.9.76)
# plug-ins: Python Interpreter, LunchBox

temp_c = Panel("""621
503""")

# ----
# Working!!
list = ValueList({"Hot rolled bars": 0, "Cold worked bars": 4, "Cold worked prestressing steel": 8, "Quenched and tempered, 1500 MPa": 12, "Quenched and self-tempered, 550 MPa": 16}, selected="Cold worked bars")
temp_c_2 = Panel(temp_c)
list_2 = ValueList({"0.2% stress": 1, "2.0% stress": 2}, selected="2.0% stress")
cluster = Cluster(rebar_type=list, stress_type=list_2, temperature_in_xy_point_s=temp_c_2)
panel = Panel(cluster)

# ----
# Working!!
temp_c_3 = Panel("300")
list_3 = ValueList({"Siliceous": 1, "Main group": 2, "Light aggregate": 3}, selected="Main group")
concdeter = DeteriorationOfConcrete(concrete_type=list_3, temperature=temp_c_3)  # -> hot_condition, cold_condition
panel_2 = Panel(concdeter.hot_condition)
panel_3 = Panel(concdeter.cold_condition)

stress_type = StressType()
temperature_in_xy_point_s = TemperatureInXyPointS()
rebar_type = RebarType()
concrete_type = ConcreteType()
temperature = Temperature()
panel_4 = Panel("C:\Users\Thomas Dyhr\Dropbox\Algoritmic modelling - Grasshopper\Deterioration Constants for Concrete.xlsx")
panel_5 = Panel("C:\Users\Thomas Dyhr\Dropbox\Algoritmic modelling - Grasshopper\Deterioration Constants for Reinforcement Steel.xlsx")
data = Data(temp_c_2)
# Deterioration of Concrete
excelread = ExcelReader(ReadExcelData=Toggle(False), WorkbookPath=panel_4, WorksheetName="Sheet1")  # -> Exceptions, ExcelData
excelread_2 = ExcelReader(ReadExcelData=Toggle(False), WorkbookPath=panel_5, WorksheetName="Sheet1")  # -> Exceptions, ExcelData

# ---- group: Connect for change
data_2 = Data(excelread.ExcelData)
data_3 = Data(Tree({0}: ["k", "0", "0", "0", "0", "0", "0"], {1}: ["T1", "15000", "3500", "100000", "10000", "100000", "4000"], {2}: ["T2", "800", "600", "1080", "780", "1100", "650"], {3}: ["T8", "570", "480", "690", "490", "800", "830"], {4}: ["T64", "100000", "680", "1000", "100000", "940", "930"]))

data_4 = Data(excelread_2.ExcelData)
data_5 = Data(Tree({0}: ["k", "0", "0", "1", "1", "0", "0", "0.580", "0.520", "0", "0", "0.2", "0.2", "0", "0", "0.213", "0.213", "0", "0", "0.418", "0.437"], {1}: ["T1", "6000", "100000", "100000", "100000", "100000", "100000", "100000", "100000", "2000", "100000", "100000", "100000", "1100", "3000", "100000", "100000", "6000", "100000", "100000", "100000"], {2}: ["T2", "620", "100000", "100000", "100000", "900", "5000", "5000", "1500", "360", "490", "750", "950", "100000", "1400", "10000", "10000", "1150", "100000", "100000", "100000"], {3}: ["T8", "565", "593", "100000", "100000", "555", "560", "590", "580", "430", "450", "550", "550", "430", "450", "590", "590", "540", "590", "700", "700"], {4}: ["T64", "1100", "100000", "100000", "100000", "100000", "100000", "730", "650", "100000", "100000", "650", "650", "100000", "100000", "660", "660", "700", "700", "900", "900"]))

# ----
# Deterioration of Steel
addition = Addition(A=list, B=list_2)
python = PythonScript(ConType=concrete_type)  # -> out, a; same code as python
data_6 = Data(temperature)
panel_6 = Panel(data_3)
addition_2 = Addition(A=addition, B=2)
panel_7 = Panel(data_5)
cull_i = CullIndex(List=panel_6, Indices=python.a, Wrap=True)
item = ListItem(List=cull_i, Index=1, Wrap=True)  # -> flatten(Item)
item_2 = ListItem(List=cull_i, Index=0, Wrap=True)  # -> flatten(Item)
item_3 = ListItem(List=panel_7, Index=addition, Wrap=True)  # -> flatten(Item)
item_4 = ListItem(List=panel_7, Index=addition_2, Wrap=True)  # -> flatten(Item)
item_5 = ListItem(List=item_2, Index="0", Wrap=True)  # -> flatten(Item)
item_6 = ListItem(List=item_2, Index="1", Wrap=True)  # -> flatten(Item)
item_7 = ListItem(List=item, Index="0", Wrap=True)  # -> flatten(Item)
item_8 = ListItem(List=item, Index="1", Wrap=True)  # -> flatten(Item)
item_9 = ListItem(List=item_2, Index="2", Wrap=True)  # -> flatten(Item)
item_10 = ListItem(List=item_2, Index="3", Wrap=True)  # -> flatten(Item)
item_11 = ListItem(List=item_2, Index="4", Wrap=True)  # -> flatten(Item)
item_12 = ListItem(List=item, Index="2", Wrap=True)  # -> flatten(Item)
item_13 = ListItem(List=item, Index="3", Wrap=True)  # -> flatten(Item)
item_14 = ListItem(List=item, Index="4", Wrap=True)  # -> flatten(Item)
item_15 = ListItem(List=item_3, Index="0", Wrap=True)  # -> flatten(Item)
item_16 = ListItem(List=item_3, Index="1", Wrap=True)  # -> flatten(Item)
item_17 = ListItem(List=item_3, Index="2", Wrap=True)  # -> flatten(Item)
item_18 = ListItem(List=item_3, Index="3", Wrap=True)  # -> flatten(Item)
item_19 = ListItem(List=item_3, Index="4", Wrap=True)  # -> flatten(Item)
item_20 = ListItem(List=item_4, Index="0", Wrap=True)  # -> flatten(Item)
item_21 = ListItem(List=item_4, Index="1", Wrap=True)  # -> flatten(Item)
item_22 = ListItem(List=item_4, Index="2", Wrap=True)  # -> flatten(Item)
item_23 = ListItem(List=item_4, Index="3", Wrap=True)  # -> flatten(Item)
item_24 = ListItem(List=item_4, Index="4", Wrap=True)  # -> flatten(Item)

# ---- group: Material Deterioration HOT
material_deterioration = Expression(
    T=data_6,
    k=item_5,
    T1=item_6,
    T2=item_9,
    T8=item_10,
    T64=item_11,
    Expression="k+((1-k)/(1+(T/T1)+(T/T2)^2+(T/T8)^8+(T/T64)^64))")

# ---- group: Material Deterioration COLD
material_deterioration_2 = Expression(
    T=data_6,
    k=item_7,
    T1=item_8,
    T2=item_12,
    T8=item_13,
    T64=item_14,
    Expression="k+((1-k)/(1+(T/T1)+(T/T2)^2+(T/T8)^8+(T/T64)^64))")

# ---- group: Material Deterioration HOT
material_deterioration_3 = Expression(
    T=data,
    k=item_15,
    T1=item_16,
    T2=item_17,
    T8=item_18,
    T64=item_19,
    Expression="k+((1-k)/(1+(T/T1)+(T/T2)^2+(T/T8)^8+(T/T64)^64))")

# ---- group: Material Deterioration COLD
material_deterioration_4 = Expression(
    T=data,
    k=item_20,
    T1=item_21,
    T2=item_22,
    T8=item_23,
    T64=item_24,
    Expression="k+((1-k)/(1+(T/T1)+(T/T2)^2+(T/T8)^8+(T/T64)^64))")

# ----
xi_t = Data(material_deterioration)
xi_t_2 = Data(material_deterioration_2)
xi_t_3 = Data(material_deterioration_3)
xi_t_4 = Data(material_deterioration_4)
hot_condition = HotCondition(xi_t)
cold_condition = ColdCondition(xi_t_2)
steel_deterioration = SteelDeterioration(xi_t_3)
steel_deterioration_2 = SteelDeterioration(xi_t_4)

# ==== cluster DeteriorationOfConcrete
concrete_type = ClusterInput()
temperature = ClusterInput()
panel = Panel("C:\Users\Thomas Dyhr\Dropbox\Algoritmic modelling - Grasshopper\Deterioration Constants for Concrete.xlsx")
excelread = ExcelReader(ReadExcelData=Toggle(False), WorkbookPath=panel, WorksheetName="Sheet1")  # -> Exceptions, ExcelData
data = Data(excelread.ExcelData)
python = PythonScript(ConType=concrete_type)  # -> out, a
# ---------- python: Python ----------
if ConType==1:
    a=[0,3,4,5,6]
elif ConType==2:
    a=[0,1,2,5,6]
else:
    a=[0,1,2,3,4]
# ---------- end python ----------
data_2 = Data(Tree({0}: ["k", "0", "0", "0", "0", "0", "0"], {1}: ["T1", "15000", "3500", "100000", "10000", "100000", "4000"], {2}: ["T2", "800", "600", "1080", "780", "1100", "650"], {3}: ["T8", "570", "480", "690", "490", "800", "830"], {4}: ["T64", "100000", "680", "1000", "100000", "940", "930"]))
data_3 = Data(temperature)
panel_2 = Panel(data_2)
cull_i = CullIndex(List=panel_2, Indices=python.a, Wrap=True)
item = ListItem(List=cull_i, Index=1, Wrap=True)  # -> flatten(Item)
item_2 = ListItem(List=cull_i, Index=0, Wrap=True)  # -> flatten(Item)
item_3 = ListItem(List=item_2, Index="0", Wrap=True)  # -> flatten(Item)
item_4 = ListItem(List=item_2, Index="1", Wrap=True)  # -> flatten(Item)
item_5 = ListItem(List=item, Index="0", Wrap=True)  # -> flatten(Item)
item_6 = ListItem(List=item, Index="1", Wrap=True)  # -> flatten(Item)
item_7 = ListItem(List=item_2, Index="2", Wrap=True)  # -> flatten(Item)
item_8 = ListItem(List=item_2, Index="3", Wrap=True)  # -> flatten(Item)
item_9 = ListItem(List=item_2, Index="4", Wrap=True)  # -> flatten(Item)
item_10 = ListItem(List=item, Index="2", Wrap=True)  # -> flatten(Item)
item_11 = ListItem(List=item, Index="3", Wrap=True)  # -> flatten(Item)
item_12 = ListItem(List=item, Index="4", Wrap=True)  # -> flatten(Item)
material_deterioration = Expression(
    T=data_3,
    k=item_3,
    T1=item_4,
    T2=item_7,
    T8=item_8,
    T64=item_9,
    Expression="k+((1-k)/(1+(T/T1)+(T/T2)^2+(T/T8)^8+(T/T64)^64))")
material_deterioration_2 = Expression(
    T=data_3,
    k=item_5,
    T1=item_6,
    T2=item_10,
    T8=item_11,
    T64=item_12,
    Expression="k+((1-k)/(1+(T/T1)+(T/T2)^2+(T/T8)^8+(T/T64)^64))")
xi_t = Data(material_deterioration)
xi_t_2 = Data(material_deterioration_2)
hot_condition = ClusterOutput(xi_t)
cold_condition = ClusterOutput(xi_t_2)

# ==== cluster Cluster
stress_type = ClusterInput()
temperature_in_xy_point_s = ClusterInput()
rebar_type = ClusterInput()
panel = Panel("C:\Users\Thomas Dyhr\Dropbox\Algoritmic modelling - Grasshopper\Deterioration Constants for Reinforcement Steel.xlsx")
data = Data(temperature_in_xy_point_s)
excelread = ExcelReader(ReadExcelData=Toggle(False), WorkbookPath=panel, WorksheetName="Sheet1")  # -> Exceptions, ExcelData
data_2 = Data(excelread.ExcelData)
data_3 = Data(Tree({0}: ["k", "0", "0", "1", "1", "0", "0", "0.580", "0.520", "0", "0", "0.2", "0.2", "0", "0", "0.213", "0.213", "0", "0", "0.418", "0.437"], {1}: ["T1", "6000", "100000", "100000", "100000", "100000", "100000", "100000", "100000", "2000", "100000", "100000", "100000", "1100", "3000", "100000", "100000", "6000", "100000", "100000", "100000"], {2}: ["T2", "620", "100000", "100000", "100000", "900", "5000", "5000", "1500", "360", "490", "750", "950", "100000", "1400", "10000", "10000", "1150", "100000", "100000", "100000"], {3}: ["T8", "565", "593", "100000", "100000", "555", "560", "590", "580", "430", "450", "550", "550", "430", "450", "590", "590", "540", "590", "700", "700"], {4}: ["T64", "1100", "100000", "100000", "100000", "100000", "100000", "730", "650", "100000", "100000", "650", "650", "100000", "100000", "660", "660", "700", "700", "900", "900"]))
panel_2 = Panel(data_3)
addition = Addition(A=rebar_type, B=stress_type)
item = ListItem(List=panel_2, Index=addition, Wrap=True)  # -> flatten(Item)
item_2 = ListItem(List=item, Index="0", Wrap=True)  # -> flatten(Item)
item_3 = ListItem(List=item, Index="1", Wrap=True)  # -> flatten(Item)
item_4 = ListItem(List=item, Index="2", Wrap=True)  # -> flatten(Item)
item_5 = ListItem(List=item, Index="3", Wrap=True)  # -> flatten(Item)
item_6 = ListItem(List=item, Index="4", Wrap=True)  # -> flatten(Item)
material_deterioration = Expression(
    T=data,
    k=item_2,
    T1=item_3,
    T2=item_4,
    T8=item_5,
    T64=item_6,
    Expression="k+((1-k)/(1+(T/T1)+(T/T2)^2+(T/T8)^8+(T/T64)^64))")
xi_t = Data(material_deterioration)
steel_deterioration = ClusterOutput(xi_t)
