# Grasshopper definition LoadCalculation.gh (Grasshopper 0.9.76)
# plug-ins: Python Interpreter

# ---- group: Extract viewport units
python = PythonScript()  # -> out, a, b; disabled
# ---------- python: Python ----------
import Rhino

a = Rhino.RhinoDoc.ActiveDoc.GetUnitSystemName(True, True, True, True);

if a=="m":
    Factor = 1
else:
    Factor = 0.001
b=Factor
# ---------- end python ----------

# ---- group: Beam Length
num = Number()  # disabled

# ----
panel = Panel("""8000
9000""")
list = ValueList({"Uniform distributed load": 0, "Point load in middle or end(cantilever)": 1}, selected="Uniform distributed load")
list_2 = ValueList({"Simply supported in both ends": 0, "Cantilever": 1}, selected="Simply supported in both ends")
load_kn_m = Panel("20")
load_kn = Panel("40")
division = Division(A=panel, B=1000)
loadcalc = Load_Calculation(Loads=load_kn_m, LoadType=list, Support=list_2, Lengths=division)  # -> M, V; inputs Loads: Int32, LoadType: Int32, Support: Int32, Lengths: Int32
# ---------- loadcalc: Python ----------
"""
Applied load calculation. Calculates the moment and shear capacity of a beam based on the support conditions
-----
FireSim made by Thomas Dyhr, DTU.BYG

    Args:
        Loads: Applied load on beams [kN/m] or [kN]
        LoadType: Load type - (0=uniform distributed | 1=point load in middle or end(cantilever))
        Support: Support conditions - (0=Simply supported both ends | 1=Cantilever)
        Lengths: Length of beams [m]
    Returns:
        M: Resulting moment [kNm]
        V: Resulting shear force [kN]
"""

ghenv.Component.Name = 'Load_Calculation'
ghenv.Component.NickName = 'LoadCalc'
ghenv.Component.Message = 'Load Calculation v.001'

# Import classes

## Calculations ##

#Max Moment force
if Support == 0:
    if LoadType == 0:
        M = 1/8*Loads*Lengths*Lengths
    elif LoadType == 1:
        M = 1/4*Loads*Lengths
elif Support == 1:
    if LoadType == 0:
        M = -1/2*Loads*Lengths*Lengths
    elif LoadType == 1:
        M = -Loads*Lengths

#Max Shear force
if Support == 0:
    if LoadType == 0:
        V = 1/2*Loads*Lengths
    elif LoadType == 1:
        V = 1/2*Loads
elif Support == 1:
    if LoadType == 0:
        V = Loads*Lengths
    elif LoadType == 1:
        V = Loads

M = round(M,2)
V = round(V,2)
# ---------- end loadcalc ----------
panel_2 = Panel(loadcalc.V)
panel_3 = Panel(loadcalc.M)

# ----
# Applied moment calculation of beam
# Simply supported in both ends
# Cantilever
load_kn_m_2 = Panel("20")  # disabled
load_kn_2 = Panel("40")  # disabled
panel_4 = Panel(python.a)  # disabled

# ---- group: Uniform distr. load
expression = Expression(p=load_kn_m_2, l=num, f=python.b, Expression="-1/2*p*(l*f)^2")  # disabled

expression_2 = Expression(p=load_kn_m_2, l=num, f=python.b, Expression="1/8*p*(l*f)^2")  # disabled

# ---- group: Point load in middle
expression_3 = Expression(p=load_kn_2, l=num, f=python.b, Expression="1/4*p*(l*f)")  # disabled

# ---- group: Point load (on tip of beam)
expression_4 = Expression(p=load_kn_2, l=num, f=python.b, Expression="-p*(l*f)")  # disabled

# ----
python_2 = PythonScript(x=expression_2)  # -> out, a; disabled
# ---------- python_2: Python ----------
# Round to 2 digits
a = round(x,2)
# ---------- end python_2 ----------
python_3 = PythonScript(x=expression_3)  # -> out, a; disabled; same code as python_2
python_4 = PythonScript(x=expression)  # -> out, a; disabled; same code as python_2
python_5 = PythonScript(x=expression_4)  # -> out, a; disabled; same code as python_2
m_knm = Panel(python_3.a)  # disabled
m_knm_2 = Panel(python_2.a)  # disabled
m_knm_3 = Panel(python_4.a)  # disabled
m_knm_4 = Panel(python_5.a)  # disabled
