# Grasshopper definition TemperatureProfiles.gh (Grasshopper 0.9.76)
# plug-ins: Python Interpreter

mainrebars = MainReinforcement(Size=Slider(16, range=0..100), Number=Slider(4, range=0..10))  # -> MainBars; inputs Number: Int32
# ---------- mainrebars: Python ----------
"""
Main Rebar Layout. Component that returns the settings for Main Rebars
-----
FireSim made by Thomas Dyhr, DTU.BYG

    Args:
        Size: Diamter of main rebars [mm] - Default: 16
        Number: Number of main rebars - Default: 4
    Returns:
        MainBars: Main rebar settings for the cross-section 
"""

ghenv.Component.Name = 'Main Reinforcement'
ghenv.Component.NickName = 'MainRebars'
ghenv.Component.Message = 'Main Reinforcement v.001'

## Code ##

#Defaults
defSize = 16
defNumber = 4

if not Size:
    Size = defSize
if not Number:
    Number = defNumber

#Output list
MainBars = []
MainBars.append(Size)
MainBars.append(Number)
# ---------- end mainrebars ----------

mainrebars_2 = MainReinforcement(Size=Slider(16, range=0..100), Number=Slider(4, range=0..10))  # -> MainBars; inputs Number: Int32; same code as mainrebars

shearrebars = ShearReinforcement(Size=Slider(10, range=0..100), Spacing=Slider(100, range=0..1000))  # -> ShearBars
# ---------- shearrebars: Python ----------
"""
Shear Rebar Layout. Component that returns the settings for Shear Rebars
-----
FireSim made by Thomas Dyhr, DTU.BYG

    Args:
        Size: Diameter of rebars [mm] - Default: 12
        Spacing: Spacing of shear rebars - Default: 150
    Returns:
        ShearBars: Shear rebar settings for the cross-section 
"""

ghenv.Component.Name = 'Shear Reinforcement'
ghenv.Component.NickName = 'ShearRebars'
ghenv.Component.Message = 'Shear Reinforcement v.001'

## Code ##

#Defaults
defSize = 12
defSpacing = 150

if not Size:
    Size = defSize
if not Spacing:
    Spacing = defSpacing

#Output list
ShearBars = []
ShearBars.append(Size)
ShearBars.append(Spacing)
# ---------- end shearrebars ----------

sectiongeometry = CrossSectionGeometry(
    Width=Slider(250, range=0..1000),
    Height=Slider(500, range=0..1000),
    RebarsTop=mainrebars_2,
    RebarsBot=mainrebars,
    ShearBars=shearrebars,
    Cover=Slider(32, range=0..100))  # -> Section, AreaTop, xyTop, dsTop, AreaBot, xyBot, dsBot; inputs Width: Int32, Height: Int32, RebarsTop: list of Int32, RebarsBot: list of Int32, ShearBars: list of Int32, Cover: Int32
# ---------- sectiongeometry: Python ----------
"""
Cross-section geometry. Returns the geometry of the cross-section based on input values
-----
FireSim made by Thomas Dyhr, DTU.BYG

    Args:
        Width: Widht of cross-section [mm]
        Height: Height of cross-section [mm]
        RebarsTop: Input settings for rebars in "top" of cross-section
        RebarsBot: Input settings for rebars in "bot" of cross-section
        ShearBars: Input settings for shear rebars in cross-section
        Cover: Cover thickness [mm] (From concrete edge to shear rebar's outer edge) 
    Returns:
        Section: Conctains a list of curves that determines the cross-section geometry
        AreaTop: Area of each rebar in the top layer [mm2]
        xyTop: Local xy-coordinates of half of the rebars in top of the cross-section (Due to symmetry)
        dsTop: Distance from bot edge to center of top rebars [mm]
        AreaBot: Area of each rebar in the bottom layer [mm2]
        xyBot: Local xy-coordinates of half of the rebars in bottom of the cross-section (Due to symmetry)
        dsBot: Distance from top edge to center of bottom rebars [mm]
"""

ghenv.Component.Name = 'CrossSection Geometry'
ghenv.Component.NickName = 'SectionGeometry'
ghenv.Component.Message = 'CrossSection Geometry v.005'

#Import classes
import rhinoscriptsyntax as rs

## Code ##

#Defaults
defWidth = 250
defHeight = 500

#if not Size:
#    Size = defSize
#if not Number:
#    Number = defNumber

def Geo(Width,Height,RebarsTop,RebarsBot,ShearBars,Cover):
    #Create concrete section
    ConSec = rs.AddRectangle( (0,0,0) , Width, Height)
    explodeSec = rs.ExplodeCurves(ConSec)
    TopEdgeMid = rs.CurveMidPoint(explodeSec[2])
    BotEdgeMid = rs.CurveMidPoint(explodeSec[0])
    
    #Offsets for shear rebar position
    ShearOuter = rs.OffsetCurve(ConSec, TopEdgeMid , Cover)
    
    #explode = rs.ExplodeCurves(ShearOuter)
    #radius = 20
    #fill = rs.CurveFilletPoints(explode[0],explode[1],radius)
    #fillet1 = rs.AddFilletCurve(explode[0],explode[1],radius)
    #fillet2 = rs.AddFilletCurve(explode[1],explode[2],radius)
    #fillet3 = rs.AddFilletCurve(explode[2],explode[3],radius)
    #fillet4 = rs.AddFilletCurve(explode[3],explode[0],radius)
    #fillet = [fillet1,fillet2,fillet3,fillet4]
    
    ShearInner = rs.OffsetCurve(ConSec, TopEdgeMid, Cover+ShearBars[0])
    
    explodeInner = rs.ExplodeCurves(ShearInner)
    
    #Creating Top bars
    TopLine = rs.OffsetCurve(explodeInner[2], BotEdgeMid, RebarsTop[0]/2)
    TopLine = rs.ExtendCurveLength(TopLine, 0, 2, -RebarsTop[0]/2)
    DivTop = rs.DivideCurve(TopLine,RebarsTop[1]-1)
    TopBars = []
    for i in range(len(DivTop)):
        TopBars.append(rs.AddCircle(DivTop[i],RebarsTop[0]/2))
    TopLineMid = rs.CurveMidPoint(TopLine)
    #ds to Top bars
    dsTop = rs.Distance(TopLineMid,BotEdgeMid)
    
    #Creating Bot bars
    BotLine = rs.OffsetCurve(explodeInner[0], TopLineMid, RebarsBot[0]/2)
    BotLine = rs.ExtendCurveLength(BotLine, 0, 2, -RebarsBot[0]/2)
    DivBot = rs.DivideCurve(BotLine,RebarsBot[1]-1)
    BotBars = []
    for i in range(len(DivBot)):
        BotBars.append(rs.AddCircle(DivBot[i],RebarsBot[0]/2))
    BotLineMid = rs.CurveMidPoint(BotLine)
    #ds to bot bars
    dsBot = rs.Distance(BotLineMid,TopEdgeMid)
    
    #Output
    Section = [ConSec]
    for i in range(len(TopBars)):
        Section.append(TopBars[i])
    for i in range(len(BotBars)):
        Section.append(BotBars[i])
    Section.append(ShearOuter[0])
    Section.append(ShearInner[0])
    
    AreaTop = []
    for i in TopBars:
        AreaTop.append(int(rs.Area(i)))
    
    xyTop = []
    DivTop.reverse()
    for i in range(int(round(len(DivTop)/2))):
        xyTop.append(DivTop[i])
    
    AreaBot = []
    for i in BotBars:
        AreaBot.append(int(rs.Area(i)))
    
    xyBot = []
    for i in range(int(round(len(DivBot)/2))):
        xyBot.append(DivBot[i])
    
    return Section,AreaTop,xyTop,dsTop,AreaBot,xyBot,dsBot

Section,AreaTop,xyTop,dsTop,AreaBot,xyBot,dsBot = Geo(Width,Height,RebarsTop,RebarsBot,ShearBars,Cover)
# ---------- end sectiongeometry ----------
# Temperature profiles
# (Cross section temp)
# 
# FireSim
# 
# Thomas Dyhr
# 18-11-2017
# 1-side exposure
list = ValueList({"Main group": 1, "Siliceous": 2, "Light aggregate 1800 kg/m3": 3, "Light aggregate 1200 kg/m3": 4, "Light aggregate 600 kg/m3": 5}, selected="Main group")
cluster = Cluster(
    cross_section=sectiongeometry.Section,
    concrete_type=list,
    distance=[Slider(50, range=0..300), Slider(100, range=0..300), Slider(100, range=0..300)],
    time_step=Slider(120, range=0..1000),
    temperature_display=Toggle(True))  # -> temperature_at_x_2, deterioration_at_midpoint_2, deterioration_at_midpoint, stress_distribution_factor_2, stress_distribution_factor, coloured_mesh
panel = Panel(cluster.temperature_at_x_2)
panel_2 = Panel(cluster.stress_distribution_factor)
panel_3 = Panel(cluster.deterioration_at_midpoint_2)
panel_4 = Panel(cluster.deterioration_at_midpoint)
panel_5 = Panel(cluster.stress_distribution_factor_2)
cross_section = CrossSection()  # Takes a list of curves describing the cross-section ( first item in the list must be the section perimeter )
concrete_type = ConcreteType()  # Value list of chosen concrete type ( use pre-set value list from the "Settings" tab )
distance = Distance()  # Depth of the section to evaluate [mm] ( can take a list of depths and returns the temperature fore each ) - NB! x goes from left to right
time_step = TimeStep()  # Time step for temperature calculation of a standard fire [min] ( t = 0, sets the temperature at the edge to 20°C and 0°C in the middle of the section )
temperature_display = TemperatureDisplay()  # Toggle True/False for display of temperature variation through section as a function of the time

# ---- group: Section
data = Data(cross_section)

# ----
item = ListItem(List=data, Index=0, Wrap=True)
# Concrete Deterioration Mid Point
explode = Explode(Curve=item, Recursive=True)  # -> Segments, Vertices

# ---- group: Time
data_2 = Data(time_step)

# ---- group: Depth
data_3 = Data(distance)

# ---- group: ConType
data_4 = Data(concrete_type)

# ----
python = PythonScript(ConType=data_4)  # -> rho; same code as python
len = Length(Curve=explode.Segments)
bnd = Bounds(Numbers=len)
dedomain = DeconstructDomain(Domain=bnd)  # -> Start, End
tempcalc = TemperatureCalculation(t=data_2, W=dedomain.Start, x=data_3, rho=python)  # -> T, TM, Tmm; inputs W: Int32, x: list; same code as tempcalc
temperature_at_x = Panel(tempcalc.T)
temperature_at_mid = Panel(tempcalc.TM)
temperature_for_each_mm = Panel(tempcalc.Tmm)
lng = ListLength(List=temperature_for_each_mm)
dom² = ConstructDomain²(DomainU=dedomain.Start, DomainV=dedomain.End)

# ----
# Concrete Deterioration for each mm
concdeter = DeteriorationOfConcrete(concrete_type=data_4, temperature=temperature_for_each_mm)  # -> hot_condition, cold_condition

# ----
# Concrete Deterioration Mid Point
concdeter_2 = DeteriorationOfConcrete(concrete_type=data_4, temperature=temperature_at_mid)  # -> flatten(hot_condition), flatten(cold_condition)

divide = DivideDomain²(Domain=dom², UCount=lng, VCount=Slider(1, range=0..10))
subsrf = Isotrim(Surface=item, Domain=divide)
lng_2 = ListLength(List=concdeter.hot_condition)
lng_3 = ListLength(List=concdeter.cold_condition)
ma = MassAddition(Input=concdeter.hot_condition)  # -> Result, PartialResults
ma_2 = MassAddition(Input=concdeter.cold_condition)  # -> Result, PartialResults
bnd_2 = Bounds(Numbers=temperature_for_each_mm)
division = Division(A=ma_2.Result, B=lng_3)
division_2 = Division(A=ma.Result, B=lng_2)
remap = RemapNumbers(Value=temperature_for_each_mm, Source=bnd_2, Target=Domain(0, 1))  # -> Mapped, Clipped
avg_reduction = Panel(division)
avg_reduction_2 = Panel(division_2)

xicmhot = Panel(concdeter_2.hot_condition)
xicmcold = Panel(concdeter_2.cold_condition)

gradient = Gradient(
    LowerLimit="1",
    UpperLimit="0",
    Parameter=remap.Mapped,
    stops=[0: RGB(234, 38, 0), 0.482: RGB(234, 126, 0), 0.846: RGB(254, 244, 84), 1: RGB(173, 203, 249)])

# ---- group: Display
data_5 = Data(temperature_display)

# ----
filter = StreamFilter(Gate=data_5, Stream1=subsrf)
division_3 = Division(A=avg_reduction, B=xicmcold)  # -> flatten(Result)
division_4 = Division(A=avg_reduction_2, B=xicmhot)  # -> flatten(Result)

n_hot = Panel(division_4)
n_cold = Panel(division_3)

preview = CustomPreview(Geometry=filter, Shader=gradient)
data_6 = Data(flatten(tempcalc.T))
deterioration_at_midpoint = DeteriorationAtMidpoint(xicmcold)  # The reduction factor in the middle of the section in COLD condition as a function of the temperature
temperature_at_x_2 = TemperatureAtX(data_6)  # Calculated temperature at depth, x [°C]
deterioration_at_midpoint_2 = DeteriorationAtMidpoint(xicmhot)  # The reduction factor in the middle of the section in HOT condition as a function of the temperature
stress_distribution_factor = StressDistributionFactor(n_cold)  # Stress Distribution Factor in COLD condition
stress_distribution_factor_2 = StressDistributionFactor(n_hot)  # Stress Distribution Factor in HOT condition

# ==== cluster Cluster
cross_section = ClusterInput()  # Takes a list of curves describing the cross-section ( first item in the list must be the section perimeter )
concrete_type = ClusterInput()  # Value list of chosen concrete type ( use pre-set value list from the "Settings" tab )
distance = ClusterInput()  # Depth of the section to evaluate [mm] ( can take a list of depths and returns the temperature fore each ) - NB! x goes from left to right
time_step = ClusterInput()  # Time step for temperature calculation of a standard fire [min] ( t = 0, sets the temperature at the edge to 20°C and 0°C in the middle of the section )
temperature_display = ClusterInput()  # Toggle True/False for display of temperature variation through section as a function of the time

# ---- group: Section
data = Data(cross_section)

# ----
item = ListItem(List=data, Index=0, Wrap=True)
explode = Explode(Curve=item, Recursive=True)  # -> Segments, Vertices

# ---- group: Time
data_2 = Data(time_step)

# ---- group: Depth
data_3 = Data(distance)

# ---- group: ConType
data_4 = Data(concrete_type)

# ----
python = PythonScript(ConType=data_4)  # -> rho
# ---------- python: Python ----------
if ConType == 3:
    rho = 1800
elif ConType == 4:
    rho = 1200
elif ConType == 5:
    rho = 600
else:
    rho = 2300
# ---------- end python ----------
len = Length(Curve=explode.Segments)
bnd = Bounds(Numbers=len)
dedomain = DeconstructDomain(Domain=bnd)  # -> Start, End
tempcalc = TemperatureCalculation(t=data_2, W=dedomain.Start, x=data_3, rho=python)  # -> T, TM, Tmm; inputs W: Int32, x: list
# ---------- tempcalc: Python ----------
"""
Temperature Calculation. Calculates temperatures in 1-side exposed cross-section
-----
FireSim made by Thomas Dyhr, DTU.BYG

    Args:
        t: Time step for standard fire [min]
        W: Total width of cross-section [mm]
        x: Distance for temperature calculation [mm]
        rho: Density
    Returns:
        T: Temperature at distance x [°C]
        TM: Temperature at middle of cross-section [°C]
        Tmm: Temperature for each millimeter of the cross-section [°C]
"""

ghenv.Component.Name = 'Temperature Calculation'
ghenv.Component.NickName = 'TempCalc'
ghenv.Component.Message = 'Temperature Calculation v.002'

#Import classes
from math import log10, exp, pi, sqrt, sin

## Code ##

cp = 1000
Lambda = 0.75

if t<1:
    T=20
    TM=0
else:
    k = sqrt((pi*rho*cp)/(750*Lambda*t))
    T = []
    for i in range(len(x)):
        T.append(round(312*log10(8*t+1)*exp(-1.9*k*(x[i]/1000))*sin((pi/2)-k*(x[i]/1000)),2))
        
    # Temperatue at middle of cross-section
    TM = round(312*log10(8*t+1)*exp(-1.9*k*((W/2)/1000))*sin((pi/2)-k*((W/2)/1000)),2)
    # If temperature is lower than 0 it is set to 0 !!
    if TM < 0:
        TM = 0
        
    # Temperatue at each mm of the cross-section
    Tmm = []
    for i in range(1,W-1):
        Temp=(round(312*log10(8*t+1)*exp(-1.9*k*(i/1000))*sin((pi/2)-k*(i/1000)),2))
        # If temperature is lower than 0 it is set to 0 !!
        if Temp < 0:
            Temp = 0
        Tmm.append(Temp)
# ---------- end tempcalc ----------
temperature_at_x = Panel(tempcalc.T)
temperature_at_mid = Panel(tempcalc.TM)
temperature_for_each_mm = Panel(tempcalc.Tmm)
lng = ListLength(List=temperature_for_each_mm)
dom² = ConstructDomain²(DomainU=dedomain.Start, DomainV=dedomain.End)

# ----
# Concrete Deterioration for each mm
concdeter = DeteriorationOfConcrete(concrete_type=data_4, temperature=temperature_for_each_mm)  # -> hot_condition, cold_condition

# ----
# Concrete Deterioration Mid Point
concdeter_2 = DeteriorationOfConcrete(concrete_type=data_4, temperature=temperature_at_mid)  # -> flatten(hot_condition), flatten(cold_condition)

divide = DivideDomain²(Domain=dom², UCount=lng, VCount=Slider(1, range=0..10))
subsrf = Isotrim(Surface=item, Domain=divide)
mplane = MeshPlane(Boundary=subsrf, WidthCount="1", HeightCount="1")  # -> Mesh, Area
lng_2 = ListLength(List=concdeter.hot_condition)
lng_3 = ListLength(List=concdeter.cold_condition)
ma = MassAddition(Input=concdeter.hot_condition)  # -> Result, PartialResults
ma_2 = MassAddition(Input=concdeter.cold_condition)  # -> Result, PartialResults
bnd_2 = Bounds(Numbers=temperature_for_each_mm)
division = Division(A=ma_2.Result, B=lng_3)
division_2 = Division(A=ma.Result, B=lng_2)
remap = RemapNumbers(Value=temperature_for_each_mm, Source=bnd_2, Target=Domain(0, 1))  # -> Mapped, Clipped

# ---- group: Display
data_5 = Data(temperature_display)

# ----
avg_reduction = Panel(division)
avg_reduction_2 = Panel(division_2)

xicmhot = Panel(concdeter_2.hot_condition)
xicmcold = Panel(concdeter_2.cold_condition)

gradient = Gradient(
    LowerLimit="1",
    UpperLimit="0",
    Parameter=remap.Mapped,
    stops=[0: RGB(234, 38, 0), 0.482: RGB(234, 126, 0), 0.846: RGB(254, 244, 84), 1: RGB(173, 203, 249)])
filter = StreamFilter(Gate=data_5, Stream1=mplane.Mesh)
division_3 = Division(A=avg_reduction, B=xicmcold)  # -> flatten(Result)
division_4 = Division(A=avg_reduction_2, B=xicmhot)  # -> flatten(Result)

n_hot = Panel(division_4)
n_cold = Panel(division_3)

mcol = MeshColours(Mesh=simplify(graft(filter)), Colours=simplify(graft(gradient)))
data_6 = Data(flatten(tempcalc.T))
coloured_mesh = ClusterOutput(mcol)
deterioration_at_midpoint = ClusterOutput(xicmcold)  # The reduction factor in the middle of the section in COLD condition as a function of the temperature
temperature_at_x_2 = ClusterOutput(data_6)  # Calculated temperature at depth, x [°C]
deterioration_at_midpoint_2 = ClusterOutput(xicmhot)  # The reduction factor in the middle of the section in HOT condition as a function of the temperature
stress_distribution_factor = ClusterOutput(n_cold)  # Stress Distribution Factor in COLD condition
stress_distribution_factor_2 = ClusterOutput(n_hot)  # Stress Distribution Factor in HOT condition

# ==== cluster DeteriorationOfConcrete
concrete_type = ClusterInput()
temperature = ClusterInput()
panel = Panel("C:\Users\Thomas Dyhr\Dropbox\Algoritmic modelling - Grasshopper\Deterioration Constants for Concrete.xlsx")
excelread = ExcelReader(ReadExcelData=Toggle(False), WorkbookPath=panel, WorksheetName="Sheet1")  # -> Exceptions, ExcelData
data = Data(excelread.ExcelData)
python = PythonScript(ConType=concrete_type)  # -> out, a
# ---------- python: Python ----------
if ConType==2:
    a=[0,3,4,5,6]
elif ConType==1:
    a=[0,1,2,5,6]
else:
    a=[0,1,2,3,4]
# ---------- end python ----------
data_2 = Data(Tree({0}: ["k", "0", "0", "0", "0", "0", "0"], {1}: ["T1", "15000", "3500", "100000", "10000", "100000", "4000"], {2}: ["T2", "800", "600", "1080", "780", "1100", "650"], {3}: ["T8", "570", "480", "690", "490", "800", "830"], {4}: ["T64", "100000", "680", "1000", "100000", "940", "930"]))
data_3 = Data(temperature)
panel_2 = Panel(data_2)
cull_i = CullIndex(List=panel_2, Indices=python.a, Wrap=True)
item = ListItem(List=cull_i, Index=1, Wrap=True)  # -> flatten(Item)
panel_3 = Panel(item)
item_2 = ListItem(List=cull_i, Index=0, Wrap=True)  # -> flatten(Item)
item_3 = ListItem(List=item_2, Index="0", Wrap=True)  # -> flatten(Item)
item_4 = ListItem(List=item_2, Index="1", Wrap=True)  # -> flatten(Item)
item_5 = ListItem(List=item, Index="0", Wrap=True)  # -> flatten(Item)
item_6 = ListItem(List=item, Index="1", Wrap=True)  # -> flatten(Item)
item_7 = ListItem(List=item_2, Index="2", Wrap=True)  # -> flatten(Item)
item_8 = ListItem(List=item_2, Index="3", Wrap=True)  # -> flatten(Item)
item_9 = ListItem(List=item_2, Index="4", Wrap=True)  # -> flatten(Item)
item_10 = ListItem(List=item, Index="2", Wrap=True)  # -> flatten(Item)
item_11 = ListItem(List=item, Index="3", Wrap=True)  # -> flatten(Item)
item_12 = ListItem(List=item, Index="4", Wrap=True)  # -> flatten(Item)
material_deterioration = Expression(
    T=data_3,
    k=item_3,
    T1=item_4,
    T2=item_7,
    T8=item_8,
    T64=item_9,
    Expression="k+((1-k)/(1+(T/T1)+(T/T2)^2+(T/T8)^8+(T/T64)^64))")
material_deterioration_2 = Expression(
    T=data_3,
    k=item_5,
    T1=item_6,
    T2=item_10,
    T8=item_11,
    T64=item_12,
    Expression="k+((1-k)/(1+(T/T1)+(T/T2)^2+(T/T8)^8+(T/T64)^64))")
xi_t = Data(material_deterioration)
xi_t_2 = Data(material_deterioration_2)
hot_condition = ClusterOutput(xi_t)
cold_condition = ClusterOutput(xi_t_2)
